# Grasshopper definition Karamba_analysis_23082022_1704_Final_Script.gh (Grasshopper 1.0.7)
# plug-ins: Karamba3D, MetaHopper, BH.UI.Grasshopper

karamba = ColourSwatch(SwatchColor=RGBA(149, 209, 46, 95))
optimization = ColourSwatch(SwatchColor=RGBA(252, 216, 33, 95))
recolor_all = Button()

# ---- group: Background_color_change
changebackground = GhPythonScript(
    change=Toggle(True),
    newBackgroundColor=ColourSwatch(SwatchColor=RGB(207, 202, 202)),
    wireColor=RGB(110, 110, 110),
    selectedWireColor=RGB(47, 255, 0))  # inputs newBackgroundColor: Color, wireColor: Color, selectedWireColor: Color
# ---------- changebackground: Python ----------
import Grasshopper as gh
import rhinoscriptsyntax as rs

newShadeColor = rs.CreateColor(0,0,0,20)
newEdgeColor = rs.CreateColor(0,0,0,40)

if(change):
     gh.GUI.Canvas.GH_Skin.canvas_back = newBackgroundColor
     gh.GUI.Canvas.GH_Skin.canvas_shade = newShadeColor
     gh.GUI.Canvas.GH_Skin.canvas_edge = newEdgeColor
     gh.GUI.Canvas.GH_Skin.wire_default = wireColor
     gh.GUI.Canvas.GH_Skin.wire_selected_a = selectedWireColor
     gh.GUI.Canvas.GH_Skin.wire_selected_b = selectedWireColor
# ---------- end changebackground ----------

# ----
unused = ColourSwatch(SwatchColor=RGBA(250, 192, 125, 150))

# ---- group: Auto_color
analysis = ColourSwatch(SwatchColor=RGBA(232, 224, 255, 150))
out = ColourSwatch(SwatchColor=RGBA(255, 189, 189, 150))
visual = ColourSwatch(SwatchColor=RGBA(156, 255, 215, 150))
# Script Information (V1)
in = ColourSwatch(SwatchColor=RGBA(255, 231, 54, 150))
colorgroups = CSharpScript(
    Colors=[in, analysis, out, visual, unused, karamba, optimization],
    Enable=Toggle(True),
    Rename=False,
    RunOnce=recolor_all,
    Debug=False)  # -> out; inputs Colors: list of Color, Enable: Boolean, Rename: Boolean, RunOnce: Boolean, Debug: Boolean
# ---------- colorgroups: C# usings ----------
using System.Linq;
using System.Text;
using System.Reflection;
# ---------- colorgroups: C# ----------
    msg.Clear();

    
    this.Component.Message = "id: " + id.ToString();

    _debug = Debug; //Set to true to have all events printed in rhino log
    _rename = Rename;

    if (Enable)
    {
      msg.AppendFormat("Set up events on ID {0}\n", id);
      SetupDict(); // Create a dictionary of the input swatches
      SetEventHandlers(); // This would do the job.


    }
    else
    {
      RemoveEventHandlers();
    }
    if (RunOnce)
    {
      foreach(Grasshopper.Kernel.Special.GH_Group grp in Grasshopper.Instances.ActiveCanvas.Document.Objects.OfType<Grasshopper.Kernel.Special.GH_Group>())
      {
        ColorGroup(grp, null); // You decide if it should run once on all existing groups

      }
    }

    Print(msg.ToString());


    // Component setup
    Component.Description = "Set up event handlers to color groups based on prefixes such as 'in_' and 'out_'.\n"
      + "Please insert only swatcheds directly into the Colors input\n\n"
      + "MIT License. Copyright Mathias Sønderskov Schaltz 2022";
    Component.Params.Input[0].Description = "Please insert only swatcheds directly into the Colors input.\nRemember to rename them";
    Component.Params.Input[1].Description = "Toggle to run...";
    Component.Params.Input[2].Description = "Set to true if you want to automatically rename the groups and remove prefix. Default is false.";
    Component.Params.Input[3].Description = "Set to true to run it once and color all existing groups.";
    Component.Params.Input[Component.Params.Input.Count - 1].Description = "Set debug to true to get all the events printed in the rhino log";
# ---------- colorgroups: C# additional code ----------
  public static Random rnd = new Random();
  public int id = rnd.Next(0, 1000);
  StringBuilder msg = new StringBuilder();
  Dictionary<string, System.Drawing.Color> colorDict = new Dictionary<string, System.Drawing.Color>();

  bool _debug = false;
  bool _rename = false;

  public bool IdExists(int id)
  {
    IList<IGH_DocumentObject> objs = Grasshopper.Instances.ActiveCanvas.Document.Objects;
    return objs
      .OfType<IGH_Component>()
      .Where(ob => ob.NickName == this.Component.NickName)
      .Where(ob => ob.GetType().ToString() == "ScriptComponents.Component_CSNET_Script")
      .Where(ob => ob.Message == "id: " + id.ToString()).Any();

  }


  public void SetupDict()
  {
    colorDict.Clear();
    // Get all inputs to "Colors"
    IList<IGH_Param> colorSources = this.Component.Params.Input[0].Sources;
    if (colorSources.Count == 0)
    {
      throw new Exception("You forgot to setup the colors. Please input swatch components and rename them");
    }
    foreach(IGH_Param source in colorSources)
    {
      //if (source.Type.ToString() == "Grasshopper.Kernel.Types.GH_Colour")
      if (source is Grasshopper.Kernel.Special.GH_ColourSwatch)
      {
        string nickName = source.NickName.Split('_')[0].Trim() + "_";
        if(!colorDict.ContainsKey(nickName))
        {
          Grasshopper.Kernel.Special.GH_ColourSwatch swatch = (Grasshopper.Kernel.Special.GH_ColourSwatch) source;
          colorDict.Add(nickName, swatch.SwatchColour);
        }
        else
        {
          throw new Exception("Multiple swatches using the same name detected. Please rename");
        }
      }
      else
      {
        throw new Exception("Whacko! Why did you input a non-swatch into the Colors? " + source.Type.ToString());
      }

    }

    msg.AppendFormat("Set up the dictionaries with {0} colors\n", colorDict.Count);
    foreach(var pairs in colorDict)
    {
      msg.AppendFormat("{0} -> {1}\n", ("\"" + pairs.Key + "\"").PadRight(5 + colorDict.Keys.Select(k => k.Length).Max()), pairs.Value);
    }
  }

  public void SetEventHandlers()
  {

    // Always remove events first to avoid duplicates
    GrasshopperDocument.ObjectsAdded -= OnObjectsAdded;
    GrasshopperDocument.ObjectsDeleted -= OnObjectsRemoved;
    GrasshopperDocument.ObjectsDeleted -= OnDeleteThisComponent;

    // Attach events
    GrasshopperDocument.ObjectsAdded += OnObjectsAdded;
    GrasshopperDocument.ObjectsDeleted += OnObjectsRemoved;
    GrasshopperDocument.ObjectsDeleted += OnDeleteThisComponent;


    foreach(Grasshopper.Kernel.Special.GH_Group grp in GrasshopperDocument.Objects.OfType<Grasshopper.Kernel.Special.GH_Group>())
    {
      grp.ObjectChanged -= ColorGroup;
      grp.ObjectChanged += ColorGroup;

      //ColorGroup(grp, null); // Make sure to run it once
    }
    msg.AppendFormat("Added the eventhandlers on {0} existing groups and on future created groups\n", GrasshopperDocument.Objects.OfType<Grasshopper.Kernel.Special.GH_Group>().Count());
  }

  public void OnObjectsAdded(object sender, GH_DocObjectEventArgs e)
  {
    bool any = false;
    foreach (Grasshopper.Kernel.Special.GH_Group grp in e.Objects.OfType<Grasshopper.Kernel.Special.GH_Group>())
    {
      grp.ObjectChanged -= ColorGroup;
      grp.ObjectChanged += ColorGroup;
      any = true;
    }

    DebugWrite(any ? "Group Objects Added: Attaching Events to ObjectChanged" : "Objects Added - but no groups");
  }

  //Same but reversed
  public void OnObjectsRemoved(object sender, GH_DocObjectEventArgs e)
  {
    bool any = false;
    foreach (Grasshopper.Kernel.Special.GH_Group grp in e.Objects.OfType<Grasshopper.Kernel.Special.GH_Group>())
    {
      grp.ObjectChanged -= ColorGroup;
      any = true;
    }

    DebugWrite(any ? "Group Objects Removed, removing event" : "Objects Removed - although not a group");

  }



  public void RemoveEventHandlers()
  {
    GrasshopperDocument.ObjectsAdded -= OnObjectsAdded;
    GrasshopperDocument.ObjectsDeleted -= OnObjectsRemoved;


    foreach(Grasshopper.Kernel.Special.GH_Group grp in GrasshopperDocument.Objects.OfType<Grasshopper.Kernel.Special.GH_Group>())
    {
      grp.ObjectChanged -= ColorGroup;

    }
    msg.AppendFormat("Removed event handlers on document and on {0} groups\n", GrasshopperDocument.Objects.OfType<Grasshopper.Kernel.Special.GH_Group>().Count());

  }

  public void ColorGroup(object sender, EventArgs e)
  {
    if (!IdExists(id))
    {
      DebugWrite("Component not relevant. Disabling old id + " + id.ToString());
      RemoveEventHandlers();
      return;
    }

    Grasshopper.Kernel.Special.GH_Group grp = sender as Grasshopper.Kernel.Special.GH_Group;
    if (grp == null) return; //not type GH_Group
    //if (!grp.NickName.EndsWith("_")) return;

    string[] nameParts = grp.NickName.Split('_');
    if (nameParts.Length <= 1)
      return;
    string prefix = grp.NickName.Split('_')[0].Trim() + '_';

    string prefixes = String.Join(", ", colorDict.Keys.Select(k => "\"" + k + "\""));

    msg.Append("prefix " + prefix + "\n");
    if (colorDict.ContainsKey(prefix))
    {
      //if (grp.NickName.EndsWith("_"))
      grp.Colour = colorDict[prefix];
      if (_rename)
      {
        grp.NickName = grp.NickName.Replace(prefix, "");
      }

      DebugWrite("Colored " + grp.NickName);

    }
    else
    {
      DebugWrite("Group changed but not relevant: prefix " + prefix + " is not among " + prefixes);
    }

  }
  public void DebugWrite(string msg)
  {
    if (_debug)
    {
      Rhino.RhinoApp.WriteLine(String.Format("[ColGrps {0}]: {1}", id, msg));
    }
  }

  public void OnDeleteThisComponent(object sender, GH_DocObjectEventArgs e)
  {

    if (e.Objects.OfType<Grasshopper.Kernel.GH_Component>().Where(o => o.NickName == this.Component.NickName).Any())
    {
      DebugWrite("Removed template component. Removing all the eventhandlers");
      RemoveEventHandlers();
    }

  }
# ---------- end colorgroups ----------
panel = Panel(colorgroups)

# ---- group: in_
roof_split_lines = Curve(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)
deflection_boundaries = Curve([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])
roof_split_lines_vertical = Curve(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)
geometry = Geometry(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)

# ---- group: analysis_
power_of_10 = PowerOf10(Value=Slider(6, range=0..10))
# Base Inputs and Roof Mesh
settings_custom = SettingsCustom(
    StitchSeams=True,
    SimplePlanes=False,
    Refine=True,
    MinCount=power_of_10,
    MaxCount=400,
    AspectRatio=20,
    MaxDistance=0,
    MaxAngle=20,
    MinEdge=0,
    MaxEdge=0)
mesh_brep = MeshBrep(Brep=geometry, Settings=settings_custom)

power_of_10_2 = PowerOf10(Value=Slider(6, range=0..10))
settings_custom_2 = SettingsCustom(
    StitchSeams=True,
    SimplePlanes=False,
    Refine=True,
    MinCount=power_of_10_2,
    MaxCount=400,
    AspectRatio=20,
    MaxDistance=0,
    MaxAngle=20,
    MinEdge=0,
    MaxEdge=0)
mesh_brep_2 = MeshBrep(Brep=geometry, Settings=settings_custom_2)

unit_z = UnitZ(Factor=Slider(50, range=0..100))
extrude = Extrude(Base=roof_split_lines, Direction=unit_z)
mesh_split = MeshSplit(Mesh=mesh_brep_2, Splitters=extrude)
list_item = ListItem(List=mesh_split, Index=0, Wrap=True)  # -> Item, Item1
bottom_half = Geometry(list_item.Item1)
top_half = Geometry(list_item.Item)

# ---- group: Plugins_Used
# Notes: Install Metahopper Plugin to enable the document information group.
# https://www.food4rhino.com/en/app/metahopper
# Brief Description: This Script is developed to make a modular Truss from a given surface or outline
# The input surface should preferrably be a multiple of the grid size defined in the script
# Versioning: Please update the version when you make a change
# Version 1 : 31052022
document_info = DocumentInfo(AutoUpdate=False, Recursive=False)  # -> DocumentName, DocumentFilePath, Components, Params, _3rdPartyAssemblies
list_of_plugins_used = Panel(document_info._3rdPartyAssemblies)

# ----
unit_z_2 = UnitZ(Factor=Slider(50, range=0..100))
extrude_2 = Extrude(Base=roof_split_lines_vertical, Direction=unit_z_2)
area = Area(Geometry=bottom_half)  # -> Area, Centroid
area_2 = Area(Geometry=top_half)  # -> Area, Centroid
mesh_split_2 = MeshSplit(Mesh=mesh_brep, Splitters=extrude_2)
panel_2 = Panel(area_2.Area)
panel_3 = Panel(area.Area)
list_item_2 = ListItem(List=mesh_split_2, Index=0, Wrap=True)  # -> Item, Item1
second_side = Geometry(list_item_2.Item1)
first_side = Geometry(list_item_2.Item)
area_3 = Area(Geometry=first_side)  # -> Area, Centroid
area_4 = Area(Geometry=second_side)  # -> Area, Centroid
panel_4 = Panel(area_4.Area)
panel_5 = Panel(area_3.Area)
second_side_2 = Geometry(second_side)
first_side_2 = Geometry(first_side)

# ---- group: Wind Direction = 0
# Wind Load
# WIND DIRECTION = 0
# (W1) LOAD CASE A = -1.4KpA(f)+ -2.1kPa(b)
# (W2) LOAD CASE B =  -2.5KpA(f)+ -1.0kPa(b)
# -----------------------------
# WIND DIRECTION = 180
# (W3) LOAD CASE A = 2.5KpA(f)+ 2.4kPa(b)
# (W4) LOAD CASE B = 1.0KpA(f)+ 3.1kPa(b)
load_case_a_f_kpa = Panel("1.4")
load_case_b_f_kpa = Panel("2.5")
load_case_a_b_kpa = Panel("2.1")
load_case_b_b_kpa = Panel("1.0")

# ---- group: Wind Direction = 180
load_case_a_f_kpa_2 = Panel("-2.5")
load_case_b_f_kpa_2 = Panel("-1.0")
load_case_a_b_kpa_2 = Panel("-2.4")
load_case_b_b_kpa_2 = Panel("-3.1")

# ----
top_mesh = Data(mesh_brep_2)

# ---- group: Wind Direction = 90
load_case_a_f_kpa_3 = Panel("-1.2")
load_case_b_f_kpa_3 = Panel("1.1")
load_case_a_b_kpa_3 = Panel("-0.3")
load_case_b_b_kpa_3 = Panel("0.6")

# ---- group: Wind Direction = 270
load_case_a_f_kpa_4 = Panel("-0.3")
load_case_b_f_kpa_4 = Panel("0.6")
load_case_a_b_kpa_4 = Panel("-1.2")
load_case_b_b_kpa_4 = Panel("1.1")

# ----
panel_6 = Panel("""LC20
LC29""")
panel_7 = Panel("""LC21
LC30""")
panel_8 = Panel("""LC22
LC31""")
# Wind Load
panel_9 = Panel("""LC23
LC32""")
left_side = Geometry(first_side_2)
left_side_2 = Geometry(first_side_2)
left_side_3 = Geometry(first_side_2)
left_side_4 = Geometry(first_side_2)
panel_10 = Panel("""LC24
LC33""")
panel_11 = Panel("""LC25
LC34""")
panel_12 = Panel("""LC26
LC35""")
panel_13 = Panel("""LC27
LC36""")
factor = Panel("1.2")
factor_2 = Panel("0.75")
right_side = Geometry(second_side_2)
right_side_2 = Geometry(second_side_2)
right_side_3 = Geometry(second_side_2)
right_side_4 = Geometry(second_side_2)
factor_3 = Panel("1.0")
factor_4 = Panel("1.4")
second_side_3 = Geometry(second_side)
first_side_3 = Geometry(first_side)

# ---- group: Wind Direction = 0
# Wind Load
load_case_a_f_kpa_5 = Panel("1.4")
load_case_b_f_kpa_5 = Panel("2.5")
load_case_a_b_kpa_5 = Panel("2.1")
load_case_b_b_kpa_5 = Panel("1.0")

# ---- group: Wind Direction = 180
load_case_a_f_kpa_6 = Panel("-2.5")
load_case_b_f_kpa_6 = Panel("-1.0")
load_case_a_b_kpa_6 = Panel("-2.4")
load_case_b_b_kpa_6 = Panel("-3.1")

# ---- group: Wind Direction = 90
load_case_a_f_kpa_7 = Panel("-1.2")
load_case_b_f_kpa_7 = Panel("1.1")
load_case_a_b_kpa_7 = Panel("-0.3")
load_case_b_b_kpa_7 = Panel("0.6")

# ---- group: Wind Direction = 270
load_case_a_f_kpa_8 = Panel("-0.3")
load_case_b_f_kpa_8 = Panel("0.6")
load_case_a_b_kpa_8 = Panel("-1.2")
load_case_b_b_kpa_8 = Panel("1.1")

# ----
panel_14 = Panel("""LC1
LC9""")
panel_15 = Panel("""LC2
LC10""")
panel_16 = Panel("""LC3
LC11""")
# Wind Load
panel_17 = Panel("""LC4
LC12""")
left_side_5 = Geometry(first_side_3)
left_side_6 = Geometry(first_side_3)
left_side_7 = Geometry(first_side_3)
left_side_8 = Geometry(first_side_3)
panel_18 = Panel("""LC5
LC13""")
panel_19 = Panel("""LC6
LC14""")
panel_20 = Panel("""LC7
LC15""")
panel_21 = Panel("""LC8
LC16""")
right_side_5 = Geometry(second_side_3)
right_side_6 = Geometry(second_side_3)
right_side_7 = Geometry(second_side_3)
right_side_8 = Geometry(second_side_3)

# ---- group: karamba_
material_selection_karamba3d = MaterialSelectionKaramba3D(menu=[dropdown(1), dropdown(4)])
number_slider = Slider(24, range=0..100)
division = Division(A=number_slider, B=2)
cross_section_karamba3d = CrossSectionKaramba3D(
    FamilyNameOfCrossSection="DefaultCroSec",
    Material=material_selection_karamba3d,
    Diameter_cm=number_slider,
    WallThickness_cm=Slider(1.25, range=0..10),
    mode="Circular Hollow")

# ----
sw = Panel("-1.2")
panel_22 = Panel("""LC1
LC2
LC3
LC4
LC5
LC6
LC7
LC8
LC17
LC37
LC38
LC39
LC40""")
unit_z_3 = UnitZ(Factor=sw)
loads_karamba3d = LoadsKaramba3D(Vector=unit_z_3, LCase=panel_22, mode="Gravity")

sw_2 = Panel("-0.9")
panel_23 = Panel("""LC9
LC10
LC11
LC12
LC13
LC14
LC15
LC16""")
unit_z_4 = UnitZ(Factor=sw_2)
loads_karamba3d_2 = LoadsKaramba3D(Vector=unit_z_4, LCase=panel_23, mode="Gravity")

sw1_2 = Data(loads_karamba3d)
sw0_9 = Data(loads_karamba3d_2)

# ---- group: in_
web_lines = Geometry([<curve referenced from the Rhino model> x1198])
# Inputs
top_lines = Geometry([<curve referenced from the Rhino model> x680])
bottom_lines = Geometry([<curve referenced from the Rhino model> x552])

# ----
sw_3 = Panel("-1.4")
unit_z_5 = UnitZ(Factor=sw_3)
loads_karamba3d_3 = LoadsKaramba3D(Vector=unit_z_5, LCase="LC18", mode="Gravity")

sw_4 = Panel("-1.0")
panel_24 = Panel("""LC19
LC20
LC21
LC22
LC23
LC24
LC25
LC26
LC27
LC41
LC42
LC43
LC44""")
unit_z_6 = UnitZ(Factor=sw_4)
loads_karamba3d_4 = LoadsKaramba3D(Vector=unit_z_6, LCase=panel_24, mode="Gravity")

# ----
# SW
sw1_0 = Data(loads_karamba3d_4)
sw1_4 = Data(loads_karamba3d_3)
geometry_2 = Geometry([<curve referenced from the Rhino model> x20])
number_slider_2 = Slider(10, range=0..10)
unit_z_7 = UnitZ(Factor="-0.5")
unit_z_8 = UnitZ(Factor="-10")
vector_xyz = VectorXYZ(XComponent="1e8", YComponent="1e8", ZComponent="1e8")  # -> Vector, Length
vector_xyz_2 = VectorXYZ(XComponent="1e8", YComponent="1e8", ZComponent="1e8")  # -> Vector, Length
geometry_3 = Geometry([<point referenced from the Rhino model> x16])
cross_section_karamba3d_2 = CrossSectionKaramba3D(
    FamilyNameOfCrossSection="DefaultCroSec",
    CTranslation_kN_m=vector_xyz.Vector,
    CRotation_kNm_rad=vector_xyz_2.Vector,
    mode="Spring")
unit_z_9 = UnitZ(Factor="-10.5")
number_slider_3 = Slider(10, range=0..10)
panel_25 = Panel("1")  # disabled
panel_26 = Panel("""CHSH60.3x5.0
CHSH76.1x5.0
CHSH88.9x5.0
CHSH114.3x5.0
CHSH139.7x5.0
CHSH168.3x5.0
CHSH168.3x6.3
CHSH168.3x8.0
CHSH168.3x10.0
CHSH168.3x12.5
CHSH193.7x12.5
CHSH219.1x12.5
CHSH273x12.5""")  # disabled
panel_27 = Panel("T")  # disabled
panel_28 = Panel("""S01
S02
S03
S04
S05
S06
S07
S08
S09
S10
S11
S12
S13""")  # disabled
# Member numbering
panel_29 = Panel("""CHSH60.3x5.0
CHSH76.1x5.0
CHSH88.9x5.0
CHSH114.3x5.0
CHSH139.7x5.0
CHSH168.3x5.0
CHSH168.3x6.3
CHSH168.3x8.0
CHSH168.3x10.0
CHSH168.3x12.5
CHSH193.7x12.5
CHSH219.1x12.5
CHSH273x12.5""")  # disabled
number_slider_4 = Slider(0.05, range=0..0.1)  # disabled
gradient = Gradient(
    LowerLimit=0,
    UpperLimit=1,
    stops=[0: RGB(18, 89, 63), 0.204: RGB(5, 51, 110), 0.403: RGB(0, 156, 240), 0.601: RGB(97, 41, 74), 0.804: RGB(255, 135, 84), 1: RGB(255, 230, 130)])  # disabled

# ---- group: in_
panel_30 = Panel("LC2")

# ----
panel_31 = Panel("""0
11
22
30
31
32
33
34
35
1
2
3
4
5
6
7
8
9""")

# ---- group: in_
panel_32 = Panel("LC30")

# ----
list_item_3 = ListItem(List=panel_31, Index=Slider(1, range=0..17), Wrap=True)

# ---- group: in_
# Deflection Check for rest of roof Span/Deflection limit 180
panel_33 = Panel("LC23")

# ----
number = Number(list_item_3)
negative = Negative(Value=Slider(1, range=1..50))
number_2 = Number(negative)
negative_2 = Negative(Value=Slider(4, range=0..10))
# Strength
panel_34 = Panel("""CHSH60.3x5.0
CHSH76.1x5.0
CHSH88.9x5.0
CHSH114.3x5.0
CHSH139.7x5.0
CHSH168.3x5.0
CHSH168.3x6.3
CHSH168.3x8.0
CHSH168.3x10.0
CHSH168.3x12.5
CHSH193.7x12.5
CHSH219.1x12.5
CHSH273x12.5""")  # disabled
number_slider_5 = Slider(8, range=0..12)  # disabled
list_item_4 = ListItem(List=panel_34, Index=number_slider_5, Wrap=True)  # disabled
number_slider_6 = Slider(5, range=0..10)  # disabled
panel_35 = Panel(list_item_4)  # disabled
panel_36 = Panel("-1")  # disabled
panel_37 = Panel("-1")  # disabled
panel_38 = Panel("-1")  # disabled
panel_39 = Panel("-1")  # disabled
panel_40 = Panel("CHSH60.3x5.0")  # disabled
panel_41 = Panel("CHSH76.1x5.0")  # disabled
panel_42 = Panel("CHSH88.9x5.0")  # disabled
panel_43 = Panel("CHSH114.3x5.0")  # disabled
panel_44 = Panel("""CHSH139.7x5.0
CHSH168.3x12.5
CHSH168.3x6.3
CHSH168.3x8.0
CHSH168.3x10.0
CHSH168.3x5.0
CHSH193.7x12.5
CHSH219.1x12.5
CHSH273x12.5""")  # disabled
number_slider_7 = Slider(36, range=0..100)  # disabled
series = Series(Start=0, Step=1, Count=number_slider_7)  # disabled
chs = CHS(
    {"CHS 21.3x2.6": 0, "CHS 21.3x2.9": 1, "CHS 21.3x3.2": 2, "CHS 26.9x2.6": 3, "CHS 26.9x2.9": 4, "CHS 26.9x3.2": 5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}, selected="CHS 60.3x5.0": 34,
    Component="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",
    Selection=34)  # disabled
chs_2 = CHS(
    {"CHS 21.3x2.6": 0, "CHS 21.3x2.9": 1, "CHS 21.3x3.2": 2, "CHS 26.9x2.6": 3, "CHS 26.9x2.9": 4, "CHS 26.9x3.2": 5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}, selected="CHS 76.1x5.0": 44,
    Component="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",
    Selection=44)  # disabled
chs_3 = CHS(
    {"CHS 21.3x2.6": 0, "CHS 21.3x2.9": 1, "CHS 21.3x3.2": 2, "CHS 26.9x2.6": 3, "CHS 26.9x2.9": 4, "CHS 26.9x3.2": 5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}, selected="CHS 88.9x5.0": 53,
    Component="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",
    Selection=53)  # disabled
chs_4 = CHS(
    {"CHS 21.3x2.6": 0, "CHS 21.3x2.9": 1, "CHS 21.3x3.2": 2, "CHS 26.9x2.6": 3, "CHS 26.9x2.9": 4, "CHS 26.9x3.2": 5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}, selected="CHS 168.3x5.0": 86,
    Component="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",
    Selection=86)  # disabled
chs_5 = CHS(
    {"CHS 21.3x2.6": 0, "CHS 21.3x2.9": 1, "CHS 21.3x3.2": 2, "CHS 26.9x2.6": 3, "CHS 26.9x2.9": 4, "CHS 26.9x3.2": 5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}, selected="CHS 219.1x12.5": 112,
    Component="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",
    Selection=112)  # disabled
chs_6 = CHS(
    {"CHS 21.3x2.6": 0, "CHS 21.3x2.9": 1, "CHS 21.3x3.2": 2, "CHS 26.9x2.6": 3, "CHS 26.9x2.9": 4, "CHS 26.9x3.2": 5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}, selected="CHS 193.7x12.5": 101,
    Component="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",
    Selection=101)  # disabled
chs_7 = CHS(
    {"CHS 21.3x2.6": 0, "CHS 21.3x2.9": 1, "CHS 21.3x3.2": 2, "CHS 26.9x2.6": 3, "CHS 26.9x2.9": 4, "CHS 26.9x3.2": 5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}, selected="CHS 273.0x12.5": 132,
    Component="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",
    Selection=132)  # disabled
chs_8 = CHS(
    {"CHS 21.3x2.6": 0, "CHS 21.3x2.9": 1, "CHS 21.3x3.2": 2, "CHS 26.9x2.6": 3, "CHS 26.9x2.9": 4, "CHS 26.9x3.2": 5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}, selected="CHS 168.3x10.0": 91,
    Component="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",
    Selection=91)  # disabled
chs_9 = CHS(
    {"CHS 21.3x2.6": 0, "CHS 21.3x2.9": 1, "CHS 21.3x3.2": 2, "CHS 26.9x2.6": 3, "CHS 26.9x2.9": 4, "CHS 26.9x3.2": 5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}, selected="CHS 273.0x12.5": 132,
    Component="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",
    Selection=132)  # disabled
chs_10 = CHS(
    {"CHS 21.3x2.6": 0, "CHS 21.3x2.9": 1, "CHS 21.3x3.2": 2, "CHS 26.9x2.6": 3, "CHS 26.9x2.9": 4, "CHS 26.9x3.2": 5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}, selected="CHS 168.3x6.3": 88,
    Component="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",
    Selection=88)  # disabled
chs_11 = CHS(
    {"CHS 21.3x2.6": 0, "CHS 21.3x2.9": 1, "CHS 21.3x3.2": 2, "CHS 26.9x2.6": 3, "CHS 26.9x2.9": 4, "CHS 26.9x3.2": 5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}, selected="CHS 168.3x8.0": 90,
    Component="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",
    Selection=90)  # disabled
chs_12 = CHS(
    {"CHS 21.3x2.6": 0, "CHS 21.3x2.9": 1, "CHS 21.3x3.2": 2, "CHS 26.9x2.6": 3, "CHS 26.9x2.9": 4, "CHS 26.9x3.2": 5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}, selected="CHS 168.3x12.5": 93,
    Component="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",
    Selection=93)  # disabled
chs_13 = CHS(
    {"CHS 21.3x2.6": 0, "CHS 21.3x2.9": 1, "CHS 21.3x3.2": 2, "CHS 26.9x2.6": 3, "CHS 26.9x2.9": 4, "CHS 26.9x3.2": 5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}, selected="CHS 114.3x5.0": 71,
    Component="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",
    Selection=71)  # disabled
chs_14 = CHS(
    {"CHS 21.3x2.6": 0, "CHS 21.3x2.9": 1, "CHS 21.3x3.2": 2, "CHS 26.9x2.6": 3, "CHS 26.9x2.9": 4, "CHS 26.9x3.2": 5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}, selected="CHS 139.7x5.0": 80,
    Component="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",
    Selection=80)  # disabled

# ---- group: Create_Adapter
boolean_toggle = BooleanToggle(False)  # disabled
etabsadapter = ETABSAdapter(Active=boolean_toggle, Component="{ ..ctor")  # disabled

# ----
chs_15 = CHS(
    {"CHS 21.3x2.6": 0, "CHS 21.3x2.9": 1, "CHS 21.3x3.2": 2, "CHS 26.9x2.6": 3, "CHS 26.9x2.9": 4, "CHS 26.9x3.2": 5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}, selected="CHS 60.3x5.0": 34,
    Component="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",
    Selection=34)  # disabled
mesh = Mesh(<mesh referenced from the Rhino model>)  # disabled
sap2000adapter = SAP2000Adapter(Active=boolean_toggle, Component="{ ..ctor")  # disabled
face_boundaries = FaceBoundaries(Mesh=mesh)  # disabled
crv = Curve(face_boundaries)  # disabled
cls = Closed(Curve=crv)  # -> Closed, Periodic; disabled
cull = CullPattern(List=crv, CullPattern=cls.Closed)  # disabled
panel_45 = Panel(Outlines=cull, Component="{ .Panel")  # disabled

# ---- group: Push_to_ETABS
boolean_toggle_2 = BooleanToggle(True)  # disabled
push = Push(
    Adapter=sap2000adapter,
    Objects=flatten(panel_45),
    PushType="{ \"_t\" : \"System.Enum\", \"TypeName\" : { \"_t\" : \"System.Type\", \"Name\" : \"BH.oM.Adapter.PushType\", \"_bhomVersion\" : \"5.2\" }, \"Value\" : \"AdapterDefault\", \"_bhomVersion\" : \"5.2\" }",
    Active=boolean_toggle_2,
    Component="{ .Push")  # -> Objects, Success; disabled

# ----
# BHoM
createobject = CreateObject(Component="{ \"SelectedItem\" : null, \"InputParams\" : [], \"OutputParams\" : [], \"BHoM_Guid\" : \"7b2b1205-a219-4de5-a158-a3b350cc7935\", \"_bhomVersion\" : \"5.2\" }")

# ---- group: in_
top_half_2 = Geometry(top_half)
bottom_half_2 = Geometry(bottom_half)

# ----
top_half_3 = Geometry(top_half_2)
top_half_4 = Geometry(top_half_2)
top_half_5 = Geometry(top_half_2)
top_half_6 = Geometry(top_half_2)
bottom_half_3 = Geometry(bottom_half_2)
bottom_half_4 = Geometry(bottom_half_2)
bottom_half_5 = Geometry(bottom_half_2)
bottom_half_6 = Geometry(bottom_half_2)

factor_5 = Panel("1")
panel_46 = Panel(load_case_a_f_kpa)  # "KN/m2"
multiplication = Multiplication(A=panel_46, B=factor_5)
Z = UnitZ(Factor=multiplication)

panel_47 = Panel(load_case_b_f_kpa)  # "KN/m2"
multiplication_2 = Multiplication(A=panel_47, B=factor_5)
Z_2 = UnitZ(Factor=multiplication_2)

panel_48 = Panel(load_case_a_f_kpa_2)  # "KN/m2"
multiplication_3 = Multiplication(A=panel_48, B=factor_5)
Z_3 = UnitZ(Factor=multiplication_3)

panel_49 = Panel(load_case_b_f_kpa_2)  # "KN/m2"
multiplication_4 = Multiplication(A=panel_49, B=factor_5)
Z_4 = UnitZ(Factor=multiplication_4)

factor_6 = Panel("1")
panel_50 = Panel(load_case_a_f_kpa_3)  # "KN/m2"
multiplication_5 = Multiplication(A=panel_50, B=factor_6)
Z_5 = UnitZ(Factor=multiplication_5)

panel_51 = Panel(load_case_b_f_kpa_3)  # "KN/m2"
multiplication_6 = Multiplication(A=panel_51, B=factor_6)
Z_6 = UnitZ(Factor=multiplication_6)

panel_52 = Panel(load_case_a_f_kpa_4)  # "KN/m2"
multiplication_7 = Multiplication(A=panel_52, B=factor_6)
Z_7 = UnitZ(Factor=multiplication_7)

panel_53 = Panel(load_case_b_f_kpa_4)  # "KN/m2"
multiplication_8 = Multiplication(A=panel_53, B=factor_6)
Z_8 = UnitZ(Factor=multiplication_8)

kn_sdl_kn_m2 = Panel("1.2")
unit_z_10 = UnitZ(Factor=kn_sdl_kn_m2)
panel_54 = Panel("""LC1
LC2
LC3
LC4
LC5
LC6
LC7
LC8
LC17
LC37
LC38
LC39
LC40""")
refined_mesh = Geometry(top_mesh)

multiplication_9 = Multiplication(A=unit_z_10, B=factor)

kn_sdl_kn_m2_2 = Panel("1.2")
unit_z_11 = UnitZ(Factor=kn_sdl_kn_m2_2)
panel_55 = Panel("""LC9
LC10
LC11
LC12
LC13
LC14
LC15
LC16""")
refined_mesh_2 = Geometry(top_mesh)

multiplication_10 = Multiplication(A=unit_z_11, B=factor_2)

negative_3 = Negative(Value=multiplication_10)

negative_4 = Negative(Value=multiplication_9)

kn = Panel(load_case_a_b_kpa)
multiplication_11 = Multiplication(A=kn, B=factor_5)
Z_9 = UnitZ(Factor=multiplication_11)

kn_2 = Panel(load_case_b_b_kpa)
multiplication_12 = Multiplication(A=kn_2, B=factor_5)
Z_10 = UnitZ(Factor=multiplication_12)

kn_3 = Panel(load_case_a_b_kpa_2)
multiplication_13 = Multiplication(A=kn_3, B=factor_5)
Z_11 = UnitZ(Factor=multiplication_13)

kn_4 = Panel(load_case_b_b_kpa_2)
multiplication_14 = Multiplication(A=kn_4, B=factor_5)
Z_12 = UnitZ(Factor=multiplication_14)

kn_5 = Panel(load_case_a_b_kpa_3)
multiplication_15 = Multiplication(A=kn_5, B=factor_6)
Z_13 = UnitZ(Factor=multiplication_15)

kn_6 = Panel(load_case_b_b_kpa_3)
multiplication_16 = Multiplication(A=kn_6, B=factor_6)
Z_14 = UnitZ(Factor=multiplication_16)

kn_7 = Panel(load_case_a_b_kpa_4)
multiplication_17 = Multiplication(A=kn_7, B=factor_6)
Z_15 = UnitZ(Factor=multiplication_17)

kn_8 = Panel(load_case_b_b_kpa_4)
multiplication_18 = Multiplication(A=kn_8, B=factor_6)
Z_16 = UnitZ(Factor=multiplication_18)

kn_sdl_kn_m2_3 = Panel("1.2")
unit_z_12 = UnitZ(Factor=kn_sdl_kn_m2_3)
panel_56 = Panel("""LC19
LC20
LC21
LC22
LC23
LC24
LC25
LC26
LC27
LC41
LC42
LC43
LC44""")
refined_mesh_3 = Geometry(top_mesh)

multiplication_19 = Multiplication(A=unit_z_12, B=factor_3)

kn_sdl_kn_m2_4 = Panel("1.2")
unit_z_13 = UnitZ(Factor=kn_sdl_kn_m2_4)
# Wind Load 1.0
panel_57 = Panel("LC18")
refined_mesh_4 = Geometry(top_mesh)

multiplication_20 = Multiplication(A=unit_z_13, B=factor_4)

negative_5 = Negative(Value=multiplication_19)

negative_6 = Negative(Value=multiplication_20)

# ---- group: karamba_
material_selection_karamba3d_2 = MaterialSelectionKaramba3D(menu=[dropdown(1), dropdown(4)])
disassemble_material_karamba3d = DisassembleMaterialKaramba3D(Material=material_selection_karamba3d_2)  # -> Material, TypeOfMaterial, FamilyNameOfMaterial, NameOfMaterial, ElemIdentifiers, Color, YoungsModulusKNCm2Dir12, InPlaneShearModulus_kN_cm2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
panel_58 = Panel("10")
panel_59 = Panel("100")
panel_60 = Panel("""29
36
44
58
66
76
92
93
94
90
96
104
113
123""")
panel_61 = Panel("""29
36
44
58
66
76
78
79
80
82
96
104
123""")

# ----
multiplication_21 = Multiplication(A=disassemble_material_karamba3d.SpecificWeight_kN_m3, B=panel_58)
division_2 = Division(A=multiplication_21, B=panel_59)

# ---- group: karamba_ (continued)
addition = Addition(A=disassemble_material_karamba3d.SpecificWeight_kN_m3, B=division_2)
material_properties_karamba3d = MaterialPropertiesKaramba3D(
    FamilyOfMaterial=disassemble_material_karamba3d.FamilyNameOfMaterial,
    Name=disassemble_material_karamba3d.NameOfMaterial,
    ElementIdentifier=disassemble_material_karamba3d.ElemIdentifiers,
    Color=disassemble_material_karamba3d.Color,
    YoungsModulus_kN_cm2=disassemble_material_karamba3d.YoungsModulusKNCm2Dir12,
    InPlaneShearModulus_kN_cm2=disassemble_material_karamba3d.InPlaneShearModulus_kN_cm2,
    TransverseShearModulus_kN_cm2=disassemble_material_karamba3d.TransverseShearModulusKNCm2Dir12,
    SpecificWeight_kN_m3=addition,
    CoefficientOfThermalExpansion_1_C=disassemble_material_karamba3d.CoefficientOfThermalExpansion1CDir12,
    TensileStrength_kN_cm2=disassemble_material_karamba3d.TensileStrengthKNCm2Dir12,
    CompressiveStrength_kN_cm2=disassemble_material_karamba3d.CompressiveStrengthKNCm2Dir12,
    StrengthHypothesis=disassemble_material_karamba3d.StrengthHypothesis,
    mode="Isotrop")
cross_section_range_selector_karamba3d = CrossSectionRangeSelectorKaramba3D(
    MaximumHeight_cm=-1,
    MaximumWidth_cm=-1,
    Material=material_properties_karamba3d,
    menu=[dropdown(2), dropdown(2), dropdown(1)])
list_item_5 = ListItem(List=cross_section_range_selector_karamba3d, Index=panel_61, Wrap=True)
list_item_6 = ListItem(List=list_item_5, Index="142", Wrap=True)
# Cross Section Suite
panel_62 = Panel(cross_section_range_selector_karamba3d)
list_item_7 = ListItem(List=list_item_5, Index=Slider(15, range=0..15), Wrap=True)
panel_63 = Panel(list_item_5)

# ----
panel_64 = Panel(material_properties_karamba3d)
data = Data(list_item_7)

# ---- group: karamba_
explode = Explode(Curve=web_lines, Recursive=True)  # -> Segments, Vertices
web_lines_2 = Geometry(flatten(explode.Segments))
remove_duplicate_lines_karamba3d = RemoveDuplicateLinesKaramba3D(Line=web_lines_2, LimitDistance=0.005)  # -> OutLine, Info, Indexes
lng = ListLength(List=remove_duplicate_lines_karamba3d.OutLine)
series_2 = Series(Start=0, Step=1, Count=lng)
concat = Concatenate(FragmentA="WL_", FragmentB=series_2)
line_to_beam_karamba3d = LineToBeamKaramba3D(
    Line=remove_duplicate_lines_karamba3d.OutLine,
    Identifier=concat,
    CrossSection=data,
    New=True,
    Remove=True,
    LimitDistance_m=0.005,
    Bending=True,
    SetBucklingLength=True,
    ToPolylineMaxAngle=0.03,
    ToPolylineTolerance=0.01,
    ToPolylineMinEdgeLength=0.25)  # -> Element, Points, Info

explode_2 = Explode(Curve=top_lines, Recursive=True)  # -> Segments, Vertices
line = Line(explode_2.Segments)
top_lines_2 = Data(flatten(line))
# Karamba Analysis
remove_duplicate_lines_karamba3d_2 = RemoveDuplicateLinesKaramba3D(Line=top_lines_2, LimitDistance=0.005)  # -> OutLine, Info, Indexes
lng_2 = ListLength(List=remove_duplicate_lines_karamba3d_2.OutLine)
series_3 = Series(Start=0, Step=1, Count=lng_2)
concat_2 = Concatenate(FragmentA="TL_", FragmentB=series_3)
line_to_beam_karamba3d_2 = LineToBeamKaramba3D(
    Line=remove_duplicate_lines_karamba3d_2.OutLine,
    Identifier=concat_2,
    CrossSection=data,
    New=True,
    Remove=True,
    LimitDistance_m=0.005,
    Bending=True,
    SetBucklingLength=True,
    ToPolylineMaxAngle=0.03,
    ToPolylineTolerance=0.01,
    ToPolylineMinEdgeLength=0.25)  # -> Element, Points, Info

# ----
load_lines = Data(concat_2)

# ---- group: in_
top_element_identifiers = Data(load_lines)

# ----
load_lines_2 = Data(concat_2)

# ---- group: in_ (continued)
top_element_identifiers_2 = Data(load_lines_2)

# ----
top_element_identifiers_3 = Data(top_element_identifiers_2)
top_element_identifiers_4 = Data(load_lines_2)
top_element_identifiers_5 = Data(top_element_identifiers_2)
top_element_identifiers_6 = Data(top_element_identifiers_2)
top_element_identifiers_7 = Data(top_element_identifiers_2)
top_element_identifiers_8 = Data(top_element_identifiers)
top_element_identifiers_9 = Data(top_element_identifiers)
top_element_identifiers_10 = Data(top_element_identifiers)
top_element_identifiers_11 = Data(top_element_identifiers)

loads_karamba3d_wl = LoadsKaramba3D(
    Vector=Z,
    Mesh=top_half_3,
    ElementIdentifiers=top_element_identifiers_3,
    LCase=panel_6,
    mode="MeshLoad -Const.",
    menu=[buttons(on, off, off), buttons(on, on)])

loads_karamba3d_wl_2 = LoadsKaramba3D(
    Vector=Z_2,
    Mesh=top_half_4,
    ElementIdentifiers=top_element_identifiers_5,
    LCase=panel_7,
    mode="MeshLoad -Const.",
    menu=[buttons(on, off, off), buttons(on, on)])

loads_karamba3d_wl_3 = LoadsKaramba3D(
    Vector=Z_3,
    Mesh=top_half_5,
    ElementIdentifiers=top_element_identifiers_6,
    LCase=panel_8,
    mode="MeshLoad -Const.",
    menu=[buttons(on, off, off), buttons(on, on)])

loads_karamba3d_wl_4 = LoadsKaramba3D(
    Vector=Z_4,
    Mesh=top_half_6,
    ElementIdentifiers=top_element_identifiers_7,
    LCase=panel_9,
    mode="MeshLoad -Const.",
    menu=[buttons(on, off, off), buttons(on, on)])

loads_karamba3d_wl_5 = LoadsKaramba3D(
    Vector=Z_5,
    Mesh=left_side,
    ElementIdentifiers=top_element_identifiers_8,
    LCase=panel_10,
    mode="MeshLoad -Const.",
    menu=[buttons(on, off, off), buttons(on, on)])

loads_karamba3d_wl_6 = LoadsKaramba3D(
    Vector=Z_6,
    Mesh=left_side_2,
    ElementIdentifiers=top_element_identifiers_9,
    LCase=panel_11,
    mode="MeshLoad -Const.",
    menu=[buttons(on, off, off), buttons(on, on)])

loads_karamba3d_wl_7 = LoadsKaramba3D(
    Vector=Z_7,
    Mesh=left_side_3,
    ElementIdentifiers=top_element_identifiers_10,
    LCase=panel_12,
    mode="MeshLoad -Const.",
    menu=[buttons(on, off, off), buttons(on, on)])

loads_karamba3d_wl_8 = LoadsKaramba3D(
    Vector=Z_8,
    Mesh=left_side_4,
    ElementIdentifiers=top_element_identifiers_11,
    LCase=panel_13,
    mode="MeshLoad -Const.",
    menu=[buttons(on, off, off), buttons(on, on)])

top_element_identifiers_12 = Data(top_element_identifiers_4)
loads_karamba3d_sdl = LoadsKaramba3D(
    Vector=negative_3,
    Mesh=refined_mesh_2,
    ElementIdentifiers=top_element_identifiers_12,
    LCase=panel_55,
    mode="MeshLoad -Const.",
    menu=[buttons(off, on, off), buttons(on, on)])

top_element_identifiers_13 = Data(top_element_identifiers_4)
loads_karamba3d_sdl_2 = LoadsKaramba3D(
    Vector=negative_4,
    Mesh=refined_mesh,
    ElementIdentifiers=top_element_identifiers_13,
    LCase=panel_54,
    mode="MeshLoad -Const.",
    menu=[buttons(off, on, off), buttons(on, on)])

sdl1_2 = Data(loads_karamba3d_sdl_2)
sdl0_9 = Data(loads_karamba3d_sdl)

loads_karamba3d_wl_9 = LoadsKaramba3D(
    Vector=Z_9,
    Mesh=bottom_half_3,
    ElementIdentifiers=top_element_identifiers_3,
    LCase=panel_6,
    mode="MeshLoad -Const.",
    menu=[buttons(on, off, off), buttons(on, on)])

loads_karamba3d_wl_10 = LoadsKaramba3D(
    Vector=Z_10,
    Mesh=bottom_half_4,
    ElementIdentifiers=top_element_identifiers_5,
    LCase=panel_7,
    mode="MeshLoad -Const.",
    menu=[buttons(on, off, off), buttons(on, on)])

loads_karamba3d_wl_11 = LoadsKaramba3D(
    Vector=Z_11,
    Mesh=bottom_half_5,
    ElementIdentifiers=top_element_identifiers_6,
    LCase=panel_8,
    mode="MeshLoad -Const.",
    menu=[buttons(on, off, off), buttons(on, on)])

loads_karamba3d_wl_12 = LoadsKaramba3D(
    Vector=Z_12,
    Mesh=bottom_half_6,
    ElementIdentifiers=top_element_identifiers_7,
    LCase=panel_9,
    mode="MeshLoad -Const.",
    menu=[buttons(on, off, off), buttons(on, on)])

loads_karamba3d_wl_13 = LoadsKaramba3D(
    Vector=Z_13,
    Mesh=right_side,
    ElementIdentifiers=top_element_identifiers_8,
    LCase=panel_10,
    mode="MeshLoad -Const.",
    menu=[buttons(on, off, off), buttons(on, on)])

loads_karamba3d_wl_14 = LoadsKaramba3D(
    Vector=Z_14,
    Mesh=right_side_2,
    ElementIdentifiers=top_element_identifiers_9,
    LCase=panel_11,
    mode="MeshLoad -Const.",
    menu=[buttons(on, off, off), buttons(on, on)])

loads_karamba3d_wl_15 = LoadsKaramba3D(
    Vector=Z_15,
    Mesh=right_side_3,
    ElementIdentifiers=top_element_identifiers_10,
    LCase=panel_12,
    mode="MeshLoad -Const.",
    menu=[buttons(on, off, off), buttons(on, on)])

loads_karamba3d_wl_16 = LoadsKaramba3D(
    Vector=Z_16,
    Mesh=right_side_4,
    ElementIdentifiers=top_element_identifiers_11,
    LCase=panel_13,
    mode="MeshLoad -Const.",
    menu=[buttons(on, off, off), buttons(on, on)])

merge = Merge(Data1=loads_karamba3d_wl, Data2=loads_karamba3d_wl_9)
merge_2 = Merge(Data1=loads_karamba3d_wl_3, Data2=loads_karamba3d_wl_11)
merge_3 = Merge(Data1=loads_karamba3d_wl_4, Data2=loads_karamba3d_wl_12)
merge_4 = Merge(Data1=loads_karamba3d_wl_2, Data2=loads_karamba3d_wl_10)

top_element_identifiers_14 = Data(top_element_identifiers_4)
# SDL
loads_karamba3d_sdl_3 = LoadsKaramba3D(
    Vector=negative_5,
    Mesh=refined_mesh_3,
    ElementIdentifiers=top_element_identifiers_14,
    LCase=panel_56,
    mode="MeshLoad -Const.",
    menu=[buttons(off, on, off), buttons(on, on)])

top_element_identifiers_15 = Data(top_element_identifiers_4)
loads_karamba3d_sdl_4 = LoadsKaramba3D(
    Vector=negative_6,
    Mesh=refined_mesh_4,
    ElementIdentifiers=top_element_identifiers_15,
    LCase=panel_57,
    mode="MeshLoad -Const.",
    menu=[buttons(off, on, off), buttons(on, on)])

merge_5 = Merge(Data1=loads_karamba3d_wl_5, Data2=loads_karamba3d_wl_13)
merge_6 = Merge(Data1=loads_karamba3d_wl_7, Data2=loads_karamba3d_wl_15)
merge_7 = Merge(Data1=loads_karamba3d_wl_8, Data2=loads_karamba3d_wl_16)
merge_8 = Merge(Data1=loads_karamba3d_wl_6, Data2=loads_karamba3d_wl_14)
wl1_1 = Data(merge)
wl4_1 = Data(merge_3)
wl2_1 = Data(merge_4)
wl3_1 = Data(merge_2)
wl5_1 = Data(merge_5)
wl8_1 = Data(merge_7)
wl6_1 = Data(merge_8)
wl7_1 = Data(merge_6)
sdl1_4 = Data(loads_karamba3d_sdl_4)
sdl1_0 = Data(loads_karamba3d_sdl_3)

# ---- group: in_
top_element_identifiers_16 = Data(load_lines)

top_element_identifiers_17 = Data(load_lines_2)
top_half_7 = Geometry(top_half)
bottom_half_7 = Geometry(bottom_half)

# ----
kn_ll_kn_m2 = Panel("1.0")
unit_z_14 = UnitZ(Factor=kn_ll_kn_m2)
top_element_identifiers_18 = Data(top_element_identifiers_4)
negative_7 = Negative(Value=unit_z_14)
panel_65 = Panel("""LC19
LC28
LC37
LC38""")
refined_mesh_5 = Geometry(top_mesh)
loads_karamba3d_ll = LoadsKaramba3D(
    Vector=negative_7,
    Mesh=refined_mesh_5,
    ElementIdentifiers=top_element_identifiers_18,
    LCase=panel_65,
    mode="MeshLoad -Const.",
    menu=[buttons(off, off, on), buttons(on, on)])

top_half_8 = Geometry(top_half_7)
top_half_9 = Geometry(top_half_7)
top_half_10 = Geometry(top_half_7)
top_half_11 = Geometry(top_half_7)
top_element_identifiers_19 = Data(top_element_identifiers_17)

factor_7 = Panel("1.6")
panel_66 = Panel(load_case_a_f_kpa_5)  # "KN/m2"
multiplication_22 = Multiplication(A=panel_66, B=factor_7)
Z_17 = UnitZ(Factor=multiplication_22)
loads_karamba3d_wl_17 = LoadsKaramba3D(
    Vector=Z_17,
    Mesh=top_half_8,
    ElementIdentifiers=top_element_identifiers_19,
    LCase=panel_14,
    mode="MeshLoad -Const.",
    menu=[buttons(on, off, off), buttons(on, on)])

top_element_identifiers_20 = Data(top_element_identifiers_17)

panel_67 = Panel(load_case_b_f_kpa_5)  # "KN/m2"
multiplication_23 = Multiplication(A=panel_67, B=factor_7)
Z_18 = UnitZ(Factor=multiplication_23)
loads_karamba3d_wl_18 = LoadsKaramba3D(
    Vector=Z_18,
    Mesh=top_half_9,
    ElementIdentifiers=top_element_identifiers_20,
    LCase=panel_15,
    mode="MeshLoad -Const.",
    menu=[buttons(on, off, off), buttons(on, on)])

top_element_identifiers_21 = Data(top_element_identifiers_17)

panel_68 = Panel(load_case_a_f_kpa_6)  # "KN/m2"
multiplication_24 = Multiplication(A=panel_68, B=factor_7)
Z_19 = UnitZ(Factor=multiplication_24)
loads_karamba3d_wl_19 = LoadsKaramba3D(
    Vector=Z_19,
    Mesh=top_half_10,
    ElementIdentifiers=top_element_identifiers_21,
    LCase=panel_16,
    mode="MeshLoad -Const.",
    menu=[buttons(on, off, off), buttons(on, on)])

top_element_identifiers_22 = Data(top_element_identifiers_17)

panel_69 = Panel(load_case_b_f_kpa_6)  # "KN/m2"
multiplication_25 = Multiplication(A=panel_69, B=factor_7)
Z_20 = UnitZ(Factor=multiplication_25)
loads_karamba3d_wl_20 = LoadsKaramba3D(
    Vector=Z_20,
    Mesh=top_half_11,
    ElementIdentifiers=top_element_identifiers_22,
    LCase=panel_17,
    mode="MeshLoad -Const.",
    menu=[buttons(on, off, off), buttons(on, on)])

kn_ll_kn_m2_2 = Panel("0.75")
unit_z_15 = UnitZ(Factor=kn_ll_kn_m2_2)
top_element_identifiers_23 = Data(top_element_identifiers_4)
negative_8 = Negative(Value=unit_z_15)
panel_70 = Panel("""LC43
LC44""")
refined_mesh_6 = Geometry(top_mesh)
loads_karamba3d_ll_2 = LoadsKaramba3D(
    Vector=negative_8,
    Mesh=refined_mesh_6,
    ElementIdentifiers=top_element_identifiers_23,
    LCase=panel_70,
    mode="MeshLoad -Const.",
    menu=[buttons(off, off, on), buttons(on, on)])

top_element_identifiers_24 = Data(top_element_identifiers_16)

factor_8 = Panel("1.6")
panel_71 = Panel(load_case_a_f_kpa_7)  # "KN/m2"
multiplication_26 = Multiplication(A=panel_71, B=factor_8)
Z_21 = UnitZ(Factor=multiplication_26)
loads_karamba3d_wl_21 = LoadsKaramba3D(
    Vector=Z_21,
    Mesh=left_side_5,
    ElementIdentifiers=top_element_identifiers_24,
    LCase=panel_18,
    mode="MeshLoad -Const.",
    menu=[buttons(on, off, off), buttons(on, on)])

top_element_identifiers_25 = Data(top_element_identifiers_16)

panel_72 = Panel(load_case_b_f_kpa_7)  # "KN/m2"
multiplication_27 = Multiplication(A=panel_72, B=factor_8)
Z_22 = UnitZ(Factor=multiplication_27)
loads_karamba3d_wl_22 = LoadsKaramba3D(
    Vector=Z_22,
    Mesh=left_side_6,
    ElementIdentifiers=top_element_identifiers_25,
    LCase=panel_19,
    mode="MeshLoad -Const.",
    menu=[buttons(on, off, off), buttons(on, on)])

top_element_identifiers_26 = Data(top_element_identifiers_16)

panel_73 = Panel(load_case_a_f_kpa_8)  # "KN/m2"
multiplication_28 = Multiplication(A=panel_73, B=factor_8)
Z_23 = UnitZ(Factor=multiplication_28)
loads_karamba3d_wl_23 = LoadsKaramba3D(
    Vector=Z_23,
    Mesh=left_side_7,
    ElementIdentifiers=top_element_identifiers_26,
    LCase=panel_20,
    mode="MeshLoad -Const.",
    menu=[buttons(on, off, off), buttons(on, on)])

top_element_identifiers_27 = Data(top_element_identifiers_16)

panel_74 = Panel(load_case_b_f_kpa_8)  # "KN/m2"
multiplication_29 = Multiplication(A=panel_74, B=factor_8)
Z_24 = UnitZ(Factor=multiplication_29)
loads_karamba3d_wl_24 = LoadsKaramba3D(
    Vector=Z_24,
    Mesh=left_side_8,
    ElementIdentifiers=top_element_identifiers_27,
    LCase=panel_21,
    mode="MeshLoad -Const.",
    menu=[buttons(on, off, off), buttons(on, on)])

ll1_0 = Data(loads_karamba3d_ll)

kn_ll_kn_m2_3 = Panel("1.6")
unit_z_16 = UnitZ(Factor=kn_ll_kn_m2_3)
top_element_identifiers_28 = Data(top_element_identifiers_4)
panel_75 = Panel("""LC17
LC39
LC40""")
negative_9 = Negative(Value=unit_z_16)
refined_mesh_7 = Geometry(top_mesh)
# LL
loads_karamba3d_ll_3 = LoadsKaramba3D(
    Vector=negative_9,
    Mesh=refined_mesh_7,
    ElementIdentifiers=top_element_identifiers_28,
    LCase=panel_75,
    mode="MeshLoad -Const.",
    menu=[buttons(off, off, on), buttons(on, on)])

kn_9 = Panel(load_case_a_b_kpa_7)
multiplication_30 = Multiplication(A=kn_9, B=factor_8)
Z_25 = UnitZ(Factor=multiplication_30)
loads_karamba3d_wl_25 = LoadsKaramba3D(
    Vector=Z_25,
    Mesh=right_side_5,
    ElementIdentifiers=top_element_identifiers_24,
    LCase=panel_18,
    mode="MeshLoad -Const.",
    menu=[buttons(on, off, off), buttons(on, on)])

kn_10 = Panel(load_case_b_b_kpa_7)
multiplication_31 = Multiplication(A=kn_10, B=factor_8)
Z_26 = UnitZ(Factor=multiplication_31)
loads_karamba3d_wl_26 = LoadsKaramba3D(
    Vector=Z_26,
    Mesh=right_side_6,
    ElementIdentifiers=top_element_identifiers_25,
    LCase=panel_19,
    mode="MeshLoad -Const.",
    menu=[buttons(on, off, off), buttons(on, on)])

kn_11 = Panel(load_case_a_b_kpa_8)
multiplication_32 = Multiplication(A=kn_11, B=factor_8)
Z_27 = UnitZ(Factor=multiplication_32)
loads_karamba3d_wl_27 = LoadsKaramba3D(
    Vector=Z_27,
    Mesh=right_side_7,
    ElementIdentifiers=top_element_identifiers_26,
    LCase=panel_20,
    mode="MeshLoad -Const.",
    menu=[buttons(on, off, off), buttons(on, on)])

kn_12 = Panel(load_case_b_b_kpa_8)
multiplication_33 = Multiplication(A=kn_12, B=factor_8)
Z_28 = UnitZ(Factor=multiplication_33)
loads_karamba3d_wl_28 = LoadsKaramba3D(
    Vector=Z_28,
    Mesh=right_side_8,
    ElementIdentifiers=top_element_identifiers_27,
    LCase=panel_21,
    mode="MeshLoad -Const.",
    menu=[buttons(on, off, off), buttons(on, on)])

# ----
# Wind Load 1.6
ll0_75 = Data(loads_karamba3d_ll_2)
bottom_half_8 = Geometry(bottom_half_7)

kn_13 = Panel(load_case_a_b_kpa_5)
multiplication_34 = Multiplication(A=kn_13, B=factor_7)
Z_29 = UnitZ(Factor=multiplication_34)
loads_karamba3d_wl_29 = LoadsKaramba3D(
    Vector=Z_29,
    Mesh=bottom_half_8,
    ElementIdentifiers=top_element_identifiers_19,
    LCase=panel_14,
    mode="MeshLoad -Const.",
    menu=[buttons(on, off, off), buttons(on, on)])

bottom_half_9 = Geometry(bottom_half_7)

kn_14 = Panel(load_case_b_b_kpa_5)
multiplication_35 = Multiplication(A=kn_14, B=factor_7)
Z_30 = UnitZ(Factor=multiplication_35)
loads_karamba3d_wl_30 = LoadsKaramba3D(
    Vector=Z_30,
    Mesh=bottom_half_9,
    ElementIdentifiers=top_element_identifiers_20,
    LCase=panel_15,
    mode="MeshLoad -Const.",
    menu=[buttons(on, off, off), buttons(on, on)])

bottom_half_10 = Geometry(bottom_half_7)

kn_15 = Panel(load_case_a_b_kpa_6)
multiplication_36 = Multiplication(A=kn_15, B=factor_7)
Z_31 = UnitZ(Factor=multiplication_36)
loads_karamba3d_wl_31 = LoadsKaramba3D(
    Vector=Z_31,
    Mesh=bottom_half_10,
    ElementIdentifiers=top_element_identifiers_21,
    LCase=panel_16,
    mode="MeshLoad -Const.",
    menu=[buttons(on, off, off), buttons(on, on)])

bottom_half_11 = Geometry(bottom_half_7)

kn_16 = Panel(load_case_b_b_kpa_6)
multiplication_37 = Multiplication(A=kn_16, B=factor_7)
Z_32 = UnitZ(Factor=multiplication_37)
loads_karamba3d_wl_32 = LoadsKaramba3D(
    Vector=Z_32,
    Mesh=bottom_half_11,
    ElementIdentifiers=top_element_identifiers_22,
    LCase=panel_17,
    mode="MeshLoad -Const.",
    menu=[buttons(on, off, off), buttons(on, on)])

ll1_6 = Data(loads_karamba3d_ll_3)
merge_9 = Merge(Data1=loads_karamba3d_wl_17, Data2=loads_karamba3d_wl_29)
merge_10 = Merge(Data1=loads_karamba3d_wl_19, Data2=loads_karamba3d_wl_31)
merge_11 = Merge(Data1=loads_karamba3d_wl_20, Data2=loads_karamba3d_wl_32)
merge_12 = Merge(Data1=loads_karamba3d_wl_18, Data2=loads_karamba3d_wl_30)
merge_13 = Merge(Data1=loads_karamba3d_wl_21, Data2=loads_karamba3d_wl_25)
merge_14 = Merge(Data1=loads_karamba3d_wl_23, Data2=loads_karamba3d_wl_27)
merge_15 = Merge(Data1=loads_karamba3d_wl_24, Data2=loads_karamba3d_wl_28)
merge_16 = Merge(Data1=loads_karamba3d_wl_22, Data2=loads_karamba3d_wl_26)
wl1_1_2 = Data(merge_9)
wl4_1_2 = Data(merge_11)
wl2_1_2 = Data(merge_12)
wl3_1_2 = Data(merge_10)
wl5_1_2 = Data(merge_13)
wl8_1_2 = Data(merge_15)
wl6_1_2 = Data(merge_16)
wl7_1_2 = Data(merge_14)
geometry_4 = Geometry(flatten(remove_duplicate_lines_karamba3d.OutLine))
# Beam elements
geometry_5 = Geometry(flatten(remove_duplicate_lines_karamba3d_2.OutLine))
web_id = Data(concat)  # disabled
top_id = Data(concat_2)  # disabled
web_id_2 = Data(concat)
top_id_2 = Data(concat_2)

panel_76 = Panel("""LC37
LC39
LC41
LC43""")

# ---- group: karamba_
bottom_lines_2 = Data(flatten(bottom_lines))
explode_3 = Explode(Curve=bottom_lines_2, Recursive=True)  # -> flatten(Segments), Vertices

# ----
end_points = EndPoints(Curve=bottom_lines_2)  # -> Start, End
line_2 = Line(StartPoint=end_points.Start, EndPoint=end_points.End)
line_3 = Line(line_2)

# ---- group: karamba_ (continued)
remove_duplicate_lines_karamba3d_3 = RemoveDuplicateLinesKaramba3D(Line=line_3, LimitDistance=0.005)  # -> OutLine, Info, Indexes
lng_3 = ListLength(List=remove_duplicate_lines_karamba3d_3.OutLine)
series_4 = Series(Start=0, Step=1, Count=lng_3)
concat_3 = Concatenate(FragmentA="BL_", FragmentB=series_4)
line_to_beam_karamba3d_3 = LineToBeamKaramba3D(
    Line=remove_duplicate_lines_karamba3d_3.OutLine,
    Identifier=concat_3,
    CrossSection=data,
    New=True,
    Remove=True,
    LimitDistance_m=0.005,
    Bending=True,
    SetBucklingLength=True,
    ToPolylineMaxAngle=0.03,
    ToPolylineTolerance=0.01,
    ToPolylineMinEdgeLength=0.25)  # -> Element, Points, Info

# ----
geometry_6 = Geometry(flatten(explode_3.Segments))
cull_duplicates = CullDuplicates(Points=line_to_beam_karamba3d_3.Points, Tolerance=0.1, CullMode=3)  # -> Points, Indices, Valence
geometry_7 = Geometry(cull_duplicates.Points)
point_in_curves = PointInCurves(Point=geometry_7, Curves=geometry_2)  # -> Relationship, Index, Point
cull_pattern = CullPattern(List=geometry_7, CullPattern=point_in_curves.Relationship)
move = Move(Geometry=cull_pattern, Motion=unit_z_7)  # -> Geometry, Transform
move_2 = Move(Geometry=cull_pattern, Motion=unit_z_8)  # -> Geometry, Transform
line_4 = Line(StartPoint=cull_pattern, EndPoint=move.Geometry)
list_length = ListLength(List=line_4)
line_5 = Line(StartPoint=cull_pattern, EndPoint=move_2.Geometry)

# ---- group: karamba_
support_karamba3d = SupportKaramba3D(PosInd=flatten(cull_pattern), menu=[buttons(on, on, on, on, on, on)])

# ----
series_5 = Series(Start=0, Step=1, Count=list_length)
concatenate = Concatenate(FragmentA="SPRING_", FragmentB=series_5)
# Supports
line_to_beam_karamba3d_4 = LineToBeamKaramba3D(
    Line=line_4,
    Identifier=concatenate,
    CrossSection=cross_section_karamba3d_2,
    New=True,
    Remove=True,
    LimitDistance_m=0.005,
    Bending=True,
    SetBucklingLength=True,
    ToPolylineMaxAngle=0.03,
    ToPolylineTolerance=0.01,
    ToPolylineMaxEdgeLength=0.25)  # -> Element, Points, Info
move_3 = Move(Geometry=cull_pattern, Motion=unit_z_9)  # -> Geometry, Transform
line_6 = Line(StartPoint=cull_pattern, EndPoint=move_3.Geometry)

# ---- group: karamba_
merge_17 = Merge(Data1=line_to_beam_karamba3d_2.Points, Data2=line_to_beam_karamba3d.Points, Data3=line_to_beam_karamba3d_3.Points)  # -> flatten(Result)
cull_duplicates_2 = CullDuplicates(Points=merge_17, Tolerance=0.1, CullMode=3)  # -> Points, Indices, Valence

merge_18 = Merge(Data1=line_to_beam_karamba3d_2.Element, Data2=line_to_beam_karamba3d.Element, Data3=line_to_beam_karamba3d_3.Element)  # -> flatten(Result)

# ----
merge_19 = Merge(Data1=concat_2, Data2=concat, Data3=concat_3)

# ---- group: karamba_
bottom_id = Data(concat_3)
web_id_3 = Data(concat)
top_id_3 = Data(concat_2)
merge_20 = Merge(Data1=web_id_3, Data2=top_id_3, Data3=bottom_id)  # -> flatten(Result)

# ----
all_element_id = Data(merge_20)
loads_karamba3d_5 = LoadsKaramba3D(UniformChangeOfTemperature="30", ElementIdentifiers=all_element_id, LCase=panel_76, mode="Temperature")

panel_77 = Panel("""LC38
LC40
LC42
LC44""")
# T
loads_karamba3d_6 = LoadsKaramba3D(UniformChangeOfTemperature="-30", ElementIdentifiers=all_element_id, LCase=panel_77, mode="Temperature")

merge_21 = Merge(
    Data1=sdl0_9,
    Data2=sdl1_0,
    Data3=sdl1_2,
    Data4=sdl1_4,
    Data5=ll1_0,
    Data6=ll1_6,
    Data7=sw0_9,
    Data8=sw1_2,
    Data9=sw1_0,
    Data10=sw1_4,
    Data11=wl1_1,
    Data12=wl2_1,
    Data13=wl3_1,
    Data14=wl4_1,
    Data15=wl5_1,
    Data16=wl6_1,
    Data17=wl7_1,
    Data18=wl8_1,
    Data19=wl5_1_2,
    Data20=wl6_1_2,
    Data21=wl7_1_2,
    Data22=wl8_1_2,
    Data23=wl1_1_2,
    Data24=wl2_1_2,
    Data25=wl3_1_2,
    Data26=wl4_1_2,
    Data27=ll0_75,
    Data28=loads_karamba3d_5,
    Data29=loads_karamba3d_6)  # -> flatten(Result)
data_2 = Data(merge_21)
text = Text(merge_21)
ghpython_script = GhPythonScript(input_load_combinations=text)  # -> out, LC_array; inputs input_load_combinations: list
# ---------- ghpython_script: Python ----------
__author__ = "AOMAN"
__version__ = "2022.08.12"

import rhinoscriptsyntax as rs
text_list = input_load_combinations
LC_array =[]

for i in text_list:
    x=i.split(":")
    number= x[1].split("LC")
    LC_array.append(number[1])
# ---------- end ghpython_script ----------

# ---- group: karamba_
beam_joints_karamba3d = BeamJointsKaramba3D(
    AtElementIdentifiers=merge_20,
    CtKNMAtStartingNode=Vector(0, 0, 0),
    CrKNmRadAtStartingNode=Vector(0, 0, 0),
    CtKNMAtEndNode=Vector(0, 0, 0),
    CrKNmRadAtEndNode=Vector(0, 0, 0),
    menu=[buttons(off, off, off, off, on, on), buttons(off, off, off, off, on, on)])

# ----
sort_list = SortList(Keys=ghpython_script.LC_array, ValuesValuesA=text)  # -> Keys, ValuesValuesA

# ---- group: karamba_
assemble_model_karamba3d = AssembleModelKaramba3D(Elem=merge_18, Support=support_karamba3d, Load=data_2, Joint=beam_joints_karamba3d, LimitDistance_m=0.005)  # -> Model, Info, Mass_kg, CenterOfGravity, LoadCaseNames
optimize_cross_section_karamba3d = OptimizeCrossSectionKaramba3D(
    Model=assemble_model_karamba3d.Model,
    ElemIdentifiers=flatten(merge_19),
    CrossSections=flatten(list_item_5),
    MaximumUtilization=Slider(0.9, range=0..1),
    MaximumDisplacement_cm="8.6",
    UltimateLimitStateIterations=5,
    DisplacementIterations=5,
    NumberOfSamplePoints=3,
    ElasticDesign=True,
    GammaM0=1,
    GammaM1=1.1,
    SwayFrame=True)  # -> ModelWithOptimizedCrossSections, Info, Mass_kg, MaximumDisplacement_cm, ElasticEnergyChange_kNm
panel_78 = Panel(optimize_cross_section_karamba3d.Mass_kg)
analyze_karamba3d = AnalyzeKaramba3D(Model=optimize_cross_section_karamba3d.ModelWithOptimizedCrossSections)  # -> CalculatedModel, MaximumDisplacement_cm, ResultingForceOfGravity_kN, ElasticEnergyChange_kNm

# ----
panel_79 = Panel(text)
create_set = CreateSet(List=sort_list.Keys)  # -> Set, Map
member_index = MemberIndex(Set=sort_list.Keys, Member=create_set.Set)  # -> Index, Count
connected_parts_karamba3d = ConnectedPartsKaramba3D(Model=assemble_model_karamba3d.Model)  # -> ConnectedLines, ConnectedMeshes
list_item_8 = ListItem(List=sort_list.ValuesValuesA, Index=member_index.Index, Wrap=True)
text_2 = Text(list_item_8)
eigen_modes_karamba3d = EigenModesKaramba3D(
    Model=assemble_model_karamba3d.Model,
    FromIndex=1,
    NumberOfModes=Slider(15, range=0..100),
    MaximumNumberOfIterations=300,
    Epsilon=1e-07)  # -> ModelWithEigenModesAsLoadCaseResults, Eigenvalues
tree_statistics = TreeStatistics(Tree=connected_parts_karamba3d.ConnectedLines)  # -> Paths, Length, Count
bottom_id_2 = Data(concat_3)  # disabled
panel_80 = Panel(sort_list.ValuesValuesA)
# Load combinations
panel_81 = Panel(text_2)
data_3 = Data(bottom_id_2)  # disabled
element_query_karamba3d = ElementQueryKaramba3D(Model=analyze_karamba3d.CalculatedModel, ElementsIdentifiers=data_3)  # -> Model, Mass_kg, Area_m2, Volume_m3, Meshes; disabled
# Assemble model
panel_82 = Panel(tree_statistics.Count)
panel_83 = Panel(optimize_cross_section_karamba3d.Info)
select_elements_karamba3d = SelectElementsKaramba3D(Model=element_query_karamba3d.Model, ElementIdentifiers=data_3)  # -> Model, Elements; disabled
model_view_karamba3d = ModelViewKaramba3D(Model=eigen_modes_karamba3d.ModelWithEigenModesAsLoadCaseResults, ResultFactors=1, ResultCase=-1)  # -> Model, DeformedMesh, DeformedAxes, DeformedModel
disassemble_element_karamba3d = DisassembleElementKaramba3D(Element=select_elements_karamba3d.Elements)  # -> Element, ElementIdentifier, AxisOfElement, CrossSection, Joint, Material, LocalCoordinateSystem, ElementIsActive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; disabled
# Eigen modes Verification
disassemble_model_karamba3d = DisassembleModelKaramba3D(Model=model_view_karamba3d.DeformedModel)  # -> Model, Point, Beam, Shell, Support, Load, Line, Mesh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
geometry_8 = Geometry(disassemble_element_karamba3d.AxisOfElement)  # disabled
geometry_9 = Geometry(disassemble_model_karamba3d.Line)
disassemble_cross_section_karamba3d = DisassembleCrossSectionKaramba3D(CroSec=disassemble_element_karamba3d.CrossSection)  # -> CrossSection, FamilyNameOfCrossSection, TypeNameOfCrossSection, ElemIdentifiers, Color, Material, LocalEccentricity_cm, flatten(Heights_cm)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; disabled
list_length_2 = ListLength(List=top_id_3)  # disabled
series_6 = Series(Start=panel_25, Step=1, Count=list_length_2)  # disabled
match_text = MatchText(Text=graft(disassemble_cross_section_karamba3d.TypeNameOfCrossSection), Pattern=panel_26, Case=True)  # disabled
curve_middle = CurveMiddle(Curve=geometry_8)  # disabled
concatenate_2 = Concatenate(FragmentA=panel_27, FragmentB=series_6)  # disabled
cull_pattern_2 = CullPattern(List=panel_28, CullPattern=simplify(match_text))  # -> flatten(List); disabled
panel_84 = Panel(concatenate_2)  # disabled
text_tag_3d = TextTag3D(Location=curve_middle, Text=cull_pattern_2, Size=number_slider_4, Justification=7)  # disabled
panel_85 = Panel(cull_pattern_2)  # disabled
# Strength
utilization_of_elements_karamba3d = UtilizationOfElementsKaramba3D(
    AnalyzedModel=analyze_karamba3d.CalculatedModel,
    LoadCase=panel_30,
    NumberOfSamplePoints=3,
    ElasticDesign=True,
    GammaM0=1,
    GammaM1=1.1,
    SwayFrame=True,
    WithDetails=False,
    mode="Beams")  # -> AnalyzedModel, Utilization, SigMax_kN_cm2, SigMin_kN_cm2, TauMax_kN_cm2, UtilN, UtilVy, UtilVz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
model_view_karamba3d_2 = ModelViewKaramba3D(Model=analyze_karamba3d.CalculatedModel, ResultFactors=1, ResultCase=-1, Colors=gradient)  # -> Model, DeformedMesh, DeformedAxes, DeformedModel
element_query_karamba3d_2 = ElementQueryKaramba3D(Model=model_view_karamba3d_2.Model, ElementsIdentifiers=concat_2)  # -> Model, Mass_kg, Area_m2, Volume_m3, Meshes
element_query_karamba3d_3 = ElementQueryKaramba3D(Model=model_view_karamba3d_2.Model, ElementsIdentifiers=concat)  # -> Model, Mass_kg, Area_m2, Volume_m3, Meshes
element_query_karamba3d_4 = ElementQueryKaramba3D(Model=model_view_karamba3d_2.Model, ElementsIdentifiers=concat_3)  # -> Model, Mass_kg, Area_m2, Volume_m3, Meshes
geometry_10 = Geometry(element_query_karamba3d_4.Meshes)
geometry_11 = Geometry(element_query_karamba3d_2.Meshes)
geometry_12 = Geometry(element_query_karamba3d_3.Meshes)
sort_list_2 = SortList(Keys=utilization_of_elements_karamba3d.Utilization, ValuesValuesA=utilization_of_elements_karamba3d.Utilization)  # -> Keys, ValuesValuesA
larger_than = LargerThan(FirstNumber=utilization_of_elements_karamba3d.Utilization, SecondNumber="1")  # -> LargerThan, OrEqualTo
element_query_karamba3d_5 = ElementQueryKaramba3D(Model=optimize_cross_section_karamba3d.ModelWithOptimizedCrossSections)  # -> Model, Mass_kg, Area_m2, Volume_m3, Meshes

# ---- group: analysis_
disassemble_model_karamba3d_2 = DisassembleModelKaramba3D(Model=assemble_model_karamba3d.Model)  # -> Model, Point, Beam, Shell, Support, Load, Line, Mesh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
# Deflection Check for Cantilever Span/Deflection limit 120
all_node_points = Data(disassemble_model_karamba3d_2.Point)
all_node_points_flatten = Data(flatten(all_node_points))
all_node_points_graft = Point(graft(all_node_points))
support_locations = Data(cull_pattern)
distance = Distance(PointA=all_node_points_graft, PointB=support_locations)
sort_list_3 = SortList(Keys=distance, ValuesValuesA=distance)  # -> Keys, ValuesValuesA
flatten_tree = FlattenTree(Tree=all_node_points_flatten, Path="{0}")
list_item_9 = ListItem(List=sort_list_3.ValuesValuesA, Index=0, Wrap=True)
sort_list_4 = SortList(Keys=flatten(list_item_9), ValuesValuesA=flatten(list_item_9))  # -> Keys, ValuesValuesA
panel_86 = Panel(sort_list_4.ValuesValuesA)

# ----
utilization_of_elements_karamba3d_2 = UtilizationOfElementsKaramba3D(
    AnalyzedModel=analyze_karamba3d.CalculatedModel,
    LoadCase=number,
    NumberOfSamplePoints=3,
    ElasticDesign=True,
    GammaM0=1,
    GammaM1=1.1,
    SwayFrame=True,
    WithDetails=False,
    mode="Beams")  # -> AnalyzedModel, Utilization, SigMax_kN_cm2, SigMin_kN_cm2, TauMax_kN_cm2, UtilN, UtilVy, UtilVz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
beam_view_karamba3d = BeamViewKaramba3D(Model=model_view_karamba3d_2.Model)  # -> Model, MeshesOfRenderedBeams, DeformedBeamAxes, LegendColors, LegendTags
cull_pattern_3 = CullPattern(List=utilization_of_elements_karamba3d.Utilization, CullPattern=larger_than.OrEqualTo)
list_length_3 = ListLength(List=cull_pattern_3)
equality = Equality(FirstNumber=list_length_3, SecondNumber="0")  # -> Equality, Inequality
mesh_colours = MeshColours(Mesh=element_query_karamba3d_5.Meshes, Colours=ColourSwatch(SwatchColor=RGB(37, 158, 245)))  # disabled
stream_filter = StreamFilter(Gate=equality.Equality, Stream0="The Roof Fails for Stength !!!", Stream1="The Roof Passes for Strength")
legend = Legend(Colour=beam_view_karamba3d.LegendColors, Tags=["One Fish", "Two Fish", "Red Fish", "Blue Fish"], LegendType=1)  # disabled
disassemble_model_karamba3d_3 = DisassembleModelKaramba3D(Model=utilization_of_elements_karamba3d_2.AnalyzedModel)  # -> Model, Point, Beam, Shell, Support, Load, Line, Mesh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
disassemble_element_karamba3d_2 = DisassembleElementKaramba3D(Element=disassemble_model_karamba3d_3.Beam)  # -> Element, ElementIdentifier, AxisOfElement, CrossSection, Joint, Material, LocalCoordinateSystem, ElementIsActive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
utilization_of_elements_karamba3d_3 = UtilizationOfElementsKaramba3D(
    AnalyzedModel=analyze_karamba3d.CalculatedModel,
    LoadCase=Slider(10, range=0..10),
    NumberOfSamplePoints=3,
    ElasticDesign=True,
    GammaM0=1,
    GammaM1=1.1,
    SwayFrame=True,
    WithDetails=False,
    mode="Beams")  # -> AnalyzedModel, Utilization, SigMax_kN_cm2, SigMin_kN_cm2, TauMax_kN_cm2, UtilN, UtilVy, UtilVz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
disassemble_cross_section_karamba3d_2 = DisassembleCrossSectionKaramba3D(CroSec=disassemble_element_karamba3d_2.CrossSection)  # -> CrossSection, FamilyNameOfCrossSection, TypeNameOfCrossSection, ElemIdentifiers, Color, Material, LocalEccentricity_cm, Heights_cm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
element_query_karamba3d_6 = ElementQueryKaramba3D(Model=model_view_karamba3d_2.Model)  # -> Model, Mass_kg, Area_m2, Volume_m3, Meshes
sort_list_5 = SortList(Keys=utilization_of_elements_karamba3d_3.Utilization, ValuesValuesA=utilization_of_elements_karamba3d_3.UtilVy)  # -> Keys, ValuesValuesA
sort_list_6 = SortList(Keys=utilization_of_elements_karamba3d_3.Utilization, ValuesValuesA=utilization_of_elements_karamba3d_3.UtilMy)  # -> Keys, ValuesValuesA
sort_list_7 = SortList(Keys=utilization_of_elements_karamba3d_3.Utilization, ValuesValuesA=utilization_of_elements_karamba3d_3.UtilMz)  # -> Keys, ValuesValuesA
sort_list_8 = SortList(Keys=utilization_of_elements_karamba3d_3.Utilization, ValuesValuesA=utilization_of_elements_karamba3d_3.UtilN)  # -> Keys, ValuesValuesA
sort_list_9 = SortList(Keys=utilization_of_elements_karamba3d_3.Utilization, ValuesValuesA=utilization_of_elements_karamba3d_3.UtilMt)  # -> Keys, ValuesValuesA
sort_list_10 = SortList(Keys=utilization_of_elements_karamba3d_3.Utilization, ValuesValuesA=utilization_of_elements_karamba3d_3.UtilVz)  # -> Keys, ValuesValuesA
sort_list_11 = SortList(Keys=utilization_of_elements_karamba3d_3.Utilization, ValuesValuesA=utilization_of_elements_karamba3d_3.Utilization)  # -> Keys, ValuesValuesA
utilization_of_elements_karamba3d_4 = UtilizationOfElementsKaramba3D(
    AnalyzedModel=analyze_karamba3d.CalculatedModel,
    LoadCase=Slider(3, range=0..10),
    NumberOfSamplePoints=3,
    ElasticDesign=True,
    GammaM0=1,
    GammaM1=1.1,
    SwayFrame=True,
    WithDetails=False,
    mode="Beams")  # -> AnalyzedModel, Utilization, SigMax_kN_cm2, SigMin_kN_cm2, TauMax_kN_cm2, UtilN, UtilVy, UtilVz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
sort_list_12 = SortList(Keys=utilization_of_elements_karamba3d_3.Utilization, ValuesValuesA=element_query_karamba3d_6.Meshes)  # -> Keys, ValuesValuesA
list_item_10 = ListItem(List=sort_list_11.ValuesValuesA, Index=number_2, Wrap=True)
panel_87 = Panel(list_item_10)
list_item_11 = ListItem(List=sort_list_12.ValuesValuesA, Index=number_2, Wrap=True)
larger_than_2 = LargerThan(FirstNumber=utilization_of_elements_karamba3d_4.Utilization, SecondNumber="1")  # -> LargerThan, OrEqualTo
list_item_12 = ListItem(List=sort_list_10.ValuesValuesA, Index=number_2, Wrap=True)
list_item_13 = ListItem(List=sort_list_9.ValuesValuesA, Index=number_2, Wrap=True)
list_item_14 = ListItem(List=sort_list_5.ValuesValuesA, Index=number_2, Wrap=True)
list_item_15 = ListItem(List=sort_list_8.ValuesValuesA, Index=number_2, Wrap=True)
list_item_16 = ListItem(List=sort_list_6.ValuesValuesA, Index=number_2, Wrap=True)
list_item_17 = ListItem(List=sort_list_7.ValuesValuesA, Index=number_2, Wrap=True)
mesh_colours_2 = MeshColours(Mesh=list_item_11, Colours=ColourSwatch(SwatchColor=RGB(250, 15, 15)))
cull_pattern_4 = CullPattern(List=utilization_of_elements_karamba3d_4.Utilization, CullPattern=larger_than_2.LargerThan)

disassemble_model_karamba3d_4 = DisassembleModelKaramba3D(Model=optimize_cross_section_karamba3d.ModelWithOptimizedCrossSections)  # -> Model, Point, Beam, Shell, Support, Load, Line, Mesh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
disassemble_element_karamba3d_3 = DisassembleElementKaramba3D(Element=disassemble_model_karamba3d_4.Beam)  # -> Element, ElementIdentifier, AxisOfElement, CrossSection, Joint, Material, LocalCoordinateSystem, ElementIsActive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
disassemble_cross_section_karamba3d_3 = DisassembleCrossSectionKaramba3D(CroSec=disassemble_element_karamba3d_3.CrossSection)  # -> CrossSection, FamilyNameOfCrossSection, TypeNameOfCrossSection, ElemIdentifiers, Color, Material, LocalEccentricity_cm, flatten(Heights_cm)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
create_set_2 = CreateSet(List=flatten(disassemble_cross_section_karamba3d_3.Heights_cm))  # -> Set, Map
sort_list_13 = SortList(Keys=create_set_2.Set, ValuesValuesA=create_set_2.Set)  # -> Keys, ValuesValuesA
list_item_18 = ListItem(List=sort_list_13.ValuesValuesA, Index=Slider(7, range=0..8), Wrap=True)
equality_2 = Equality(FirstNumber=disassemble_cross_section_karamba3d_3.Heights_cm, SecondNumber=list_item_18)  # -> Equality, Inequality

concatenate_3 = Concatenate(
    Fragment_A="Util-N = ",
    Fragment_B=list_item_15,
    K=" ",
    A="Util-Vy = ",
    B=list_item_14,
    C=" ",
    O="Util-Vz = ",
    D=list_item_12,
    L=" ",
    E="Util-Mt = ",
    F=list_item_13,
    M=" ",
    G="Util-My = ",
    H=list_item_16,
    N=" ",
    I="Util-Mz = ",
    J=list_item_17)

element_query_karamba3d_7 = ElementQueryKaramba3D(Model=beam_view_karamba3d.Model)  # -> Model, Mass_kg, Area_m2, Volume_m3, Meshes
disassemble_model_karamba3d_5 = DisassembleModelKaramba3D(Model=element_query_karamba3d_7.Model)  # -> Model, Point, Beam, Shell, Support, Load, Line, Mesh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
panel_88 = Panel(disassemble_model_karamba3d_5.Beam)
geometry_13 = Geometry(element_query_karamba3d_7.Meshes)

panel_89 = Panel(concatenate_3)

utilization_of_elements_karamba3d_5 = UtilizationOfElementsKaramba3D(
    AnalyzedModel=analyze_karamba3d.CalculatedModel,
    NumberOfSamplePoints=3,
    ElasticDesign=True,
    GammaM0=1,
    GammaM1=1.1,
    SwayFrame=True,
    WithDetails=False,
    mode="Beams")  # -> AnalyzedModel, Utilization, SigMax_kN_cm2, SigMin_kN_cm2, TauMax_kN_cm2, UtilN, UtilVy, UtilVz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
cull_pattern_5 = CullPattern(List=utilization_of_elements_karamba3d_5.Utilization, CullPattern=equality_2.Equality)
larger_than_3 = LargerThan(FirstNumber=utilization_of_elements_karamba3d_5.Utilization, SecondNumber="0.9")  # -> LargerThan, OrEqualTo
sort_list_14 = SortList(Keys=utilization_of_elements_karamba3d_5.Utilization, ValuesValuesA=utilization_of_elements_karamba3d_5.Utilization)  # -> Keys, ValuesValuesA
sort_list_15 = SortList(Keys=cull_pattern_5, ValuesValuesA=cull_pattern_5)  # -> Keys, ValuesValuesA
cull_pattern_6 = CullPattern(List=utilization_of_elements_karamba3d_5.Utilization, CullPattern=larger_than_3.LargerThan)
panel_90 = Panel(sort_list_14.ValuesValuesA)
panel_91 = Panel(sort_list_15.Keys)

match_text_2 = MatchText(Text=disassemble_cross_section_karamba3d_2.TypeNameOfCrossSection, Pattern=list_item_4, Case=True)  # disabled
# Stream_list: Main_Top_Truss_members         = 0
# Main_Bottom_Truss_members      = 1
# Main_Truss_web_members         = 2
# Main_Truss_Beam_Top_members    = 3
# Main_Truss_Beam_Bottom_members = 4
cull_pattern_7 = CullPattern(List=disassemble_element_karamba3d_2.ElementIdentifier, CullPattern=match_text_2)  # -> flatten(List); disabled
create_set_3 = CreateSet(List=flatten(disassemble_cross_section_karamba3d_3.TypeNameOfCrossSection))  # -> Set, Map
ghpython_script_2 = GhPythonScript(List_of_Sections=create_set_3.Set)  # -> Diameter_list; inputs List_of_Sections: list
# ---------- ghpython_script_2: Python ----------
__author__ = "AOMAN"
__version__ = "2022.08.12"

import rhinoscriptsyntax as rs
iteration_list = List_of_Sections
Diameter = []

for i in iteration_list:
    split_list = i.split("CHSH")
    dimension_split_list = split_list[1].split("x")
    print(float(dimension_split_list[0]))
# ---------- end ghpython_script_2 ----------
list_item_19 = ListItem(List=cull_pattern_7, Index=number_slider_6, Wrap=True)  # disabled
beam_forces_karamba3d = BeamForcesKaramba3D(AnalyzedModel=analyze_karamba3d.CalculatedModel, BeamsIdentifiers=cull_pattern_7, LoadCase=number, Ts=[0, 1])  # -> AnalyzedModel, NormalForce_kN, ShearForceVz_kN, ShearForceVy_kN, TorsionalMomentMt_kNm, BendingMomentMy_kNm, BendingMomentMz_kNm; disabled
element_query_karamba3d_8 = ElementQueryKaramba3D(Model=analyze_karamba3d.CalculatedModel, ElementsIdentifiers=list_item_19)  # -> Model, Mass_kg, Area_m2, Volume_m3, Meshes; disabled
sort_list_16 = SortList(Keys=ghpython_script_2, ValuesValuesA=create_set_3.Set)  # -> Keys, ValuesValuesA
data_4 = Data(sort_list_16.ValuesValuesA)
absolute = Absolute(Value=beam_forces_karamba3d.NormalForce_kN)  # disabled
absolute_2 = Absolute(Value=beam_forces_karamba3d.ShearForceVy_kN)  # disabled
absolute_3 = Absolute(Value=beam_forces_karamba3d.ShearForceVz_kN)  # disabled
match_text_3 = MatchText(Text=graft(disassemble_cross_section_karamba3d_3.TypeNameOfCrossSection), Pattern=data_4, Case=True)
panel_92 = Panel(data_4)
list_length_4 = ListLength(List=data_4)
list_length_5 = ListLength(List=data_4)
sort_list_17 = SortList(Keys=absolute, ValuesValuesA=absolute)  # -> Keys, ValuesValuesA; disabled
sort_list_18 = SortList(Keys=absolute_2, ValuesValuesA=absolute_2)  # -> Keys, ValuesValuesA; disabled
sort_list_19 = SortList(Keys=absolute_3, ValuesValuesA=absolute_3)  # -> Keys, ValuesValuesA; disabled
range = Range(Domain=Domain(0, 1), Steps=expr("x-1", list_length_4))
series_7 = Series(Start=0, Step=1, Count=list_length_5)
# Member information
panel_93 = Panel(series_7)
cull_pattern_8 = CullPattern(List=series_7, CullPattern=match_text_3)  # -> flatten(List)
list_item_20 = ListItem(List=sort_list_17.ValuesValuesA, Index=panel_36, Wrap=True)  # -> flatten(Item); disabled
list_item_21 = ListItem(List=sort_list_19.ValuesValuesA, Index=panel_38, Wrap=True)  # -> flatten(Item); disabled
list_item_22 = ListItem(List=sort_list_18.ValuesValuesA, Index=panel_37, Wrap=True)  # -> flatten(Item); disabled
sort_list_20 = SortList(Keys=cull_pattern_8, ValuesValuesA=cull_pattern_8)  # -> Keys, ValuesValuesA
sort_list_21 = SortList(Keys=list_item_20, ValuesValuesA=list_item_20)  # -> Keys, ValuesValuesA; disabled
sort_list_22 = SortList(Keys=list_item_22, ValuesValuesA=list_item_22)  # -> Keys, ValuesValuesA; disabled
sort_list_23 = SortList(Keys=list_item_21, ValuesValuesA=list_item_21)  # -> Keys, ValuesValuesA; disabled
member_index_2 = MemberIndex(Set=sort_list_20.ValuesValuesA, Member=series_7)  # -> Index, Count
panel_94 = Panel(sort_list_21.ValuesValuesA)  # disabled
list_item_23 = ListItem(List=sort_list_21.ValuesValuesA, Index=panel_39, Wrap=True)  # disabled
list_item_24 = ListItem(List=sort_list_23.ValuesValuesA, Index=panel_39, Wrap=True)  # disabled
list_item_25 = ListItem(List=sort_list_22.ValuesValuesA, Index=panel_39, Wrap=True)  # disabled
panel_95 = Panel(list_item_25)  # disabled
panel_96 = Panel(list_item_23)  # disabled
panel_97 = Panel(list_item_24)  # disabled
panel_98 = Panel(list_item_23)  # disabled

# ---- group: analysis_
list_item_26 = ListItem(List=data_4, Index=Slider(7, range=0..13), Wrap=True)
match_text_4 = MatchText(Text=list_item_26, Pattern=disassemble_cross_section_karamba3d_3.TypeNameOfCrossSection, Case=True)
panel_99 = Panel(list_item_26)
cull_pattern_9 = CullPattern(List=element_query_karamba3d_7.Meshes, CullPattern=match_text_4)
cull_pattern_10 = CullPattern(List=disassemble_model_karamba3d_5.Line, CullPattern=match_text_4)
line_7 = Line(cull_pattern_10)
mesh_2 = Mesh(cull_pattern_9)

# ----
panel_100 = Panel(member_index_2.Index)
concatenate_4 = Concatenate(Fragment_A=flatten(data_4), Fragment_B=" = ", A=flatten(member_index_2.Count))
list_item_27 = ListItem(List=disassemble_model_karamba3d_5.Line, Index=member_index_2.Index, Wrap=True)  # -> simplify(Item)
panel_101 = Panel(concatenate_4)

data_recorder = DataRecorder(panel_97, DataLimit=-10, RecordData=True)  # disabled
data_recorder_2 = DataRecorder(panel_95, DataLimit=-10, RecordData=True)  # disabled
data_recorder_3 = DataRecorder(panel_98, DataLimit=-10, RecordData=True)  # disabled
panel_102 = Panel(data_recorder)  # disabled
panel_103 = Panel(data_recorder_3)  # disabled
panel_104 = Panel(data_recorder_2)  # disabled
bottom_id_3 = Data(concat_3)
element_query_karamba3d_9 = ElementQueryKaramba3D(Model=beam_view_karamba3d.Model)  # -> Model, Mass_kg, Area_m2, Volume_m3, Meshes
select_elements_karamba3d_2 = SelectElementsKaramba3D(Model=element_query_karamba3d_9.Model)  # -> Model, Elements
disassemble_element_karamba3d_4 = DisassembleElementKaramba3D(Element=select_elements_karamba3d_2.Elements)  # -> Element, ElementIdentifier, AxisOfElement, CrossSection, Joint, Material, LocalCoordinateSystem, ElementIsActive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
model = Data(optimize_cross_section_karamba3d.ModelWithOptimizedCrossSections)  # disabled

disassemble_model_karamba3d_6 = DisassembleModelKaramba3D(Model=model)  # -> Model, Point, Beam, Shell, Support, Load, Line, Mesh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; disabled
disassemble_element_karamba3d_5 = DisassembleElementKaramba3D(Element=disassemble_model_karamba3d_6.Beam)  # -> Element, ElementIdentifier, AxisOfElement, CrossSection, Joint, Material, LocalCoordinateSystem, ElementIsActive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; disabled
disassemble_cross_section_karamba3d_4 = DisassembleCrossSectionKaramba3D(CroSec=disassemble_element_karamba3d_5.CrossSection)  # -> CrossSection, FamilyNameOfCrossSection, TypeNameOfCrossSection, ElemIdentifiers, Color, Material, LocalEccentricity_cm, flatten(Heights_cm)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; disabled

geometry_14 = Geometry(disassemble_element_karamba3d_4.AxisOfElement)
disassemble_cross_section_karamba3d_5 = DisassembleCrossSectionKaramba3D(CroSec=disassemble_element_karamba3d_4.CrossSection)  # -> CrossSection, FamilyNameOfCrossSection, TypeNameOfCrossSection, ElemIdentifiers, Color, Material, LocalEccentricity_cm, flatten(Heights_cm)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
match_text_5 = MatchText(Text=simplify(graft(data_4)), Pattern=disassemble_cross_section_karamba3d_5.TypeNameOfCrossSection, Case=True)
cull_pattern_11 = CullPattern(List=element_query_karamba3d_9.Meshes, CullPattern=match_text_5)
cull_pattern_12 = CullPattern(List=geometry_14, CullPattern=match_text_5)

panel_105 = Panel("300")  # disabled
panel_106 = Panel("100")  # disabled
panel_107 = Panel("10")  # disabled
subtraction = Subtraction(A=panel_105, B=panel_106)  # disabled
division_3 = Division(A=subtraction, B=panel_107)  # disabled
series_8 = Series(Start=panel_106, Step=panel_107, Count=division_3)  # disabled
number_slider_8 = Slider(10, range=0..20)  # disabled
panel_108 = Panel("1000")  # disabled
division_4 = Division(A=series_8, B=panel_108)  # disabled
list_item_28 = ListItem(List=division_4, Index=number_slider_8, Wrap=True)  # disabled
panel_109 = Panel("2")  # disabled
division_5 = Division(A=list_item_28, B=panel_109)  # disabled
sphere = Sphere(Base=cull_duplicates_2.Points, Radius=division_5)  # disabled

heights = Data(disassemble_cross_section_karamba3d_4.Heights_cm)  # disabled
panel_110 = Panel("100")  # disabled
division_6 = Division(A=heights, B=panel_110)  # disabled
number_slider_9 = Slider(0.05, range=0..0.1)  # disabled
panel_111 = Panel("2")  # disabled
division_7 = Division(A=division_6, B=panel_111)  # disabled
larger_than_4 = LargerThan(FirstNumber=division_7, SecondNumber=number_slider_9)  # -> LargerThan, OrEqualTo; disabled

gradient_2 = Gradient(
    LowerLimit=0,
    UpperLimit=1,
    Parameter=range,
    stops=[0: RGB(234, 38, 0), 0.25: RGB(234, 126, 0), 0.5: RGB(254, 244, 84), 0.75: RGB(173, 203, 249), 1: RGB(75, 107, 169)])  # disabled
list_item_29 = ListItem(List=geometry_13, Index=member_index_2.Index, Wrap=True)  # -> simplify(Item); disabled
mesh_colours_3 = MeshColours(
    Mesh=list_item_29,
    Colours=simplify(graft([RGB(127, 255, 0), RGB(0, 100, 0), RGB(34, 139, 34), RGB(124, 252, 0), RGB(154, 205, 50), RGB(173, 255, 47), RGB(50, 205, 50), RGB(152, 251, 152)])))  # disabled
explode_tree = ExplodeTree(Data=simplify(cull_pattern_12))  # -> Branch0, Branch1, Branch2, Branch3, Branch4, Branch5, Branch6, Branch7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
explode_tree_2 = ExplodeTree(Data=cull_pattern_11)  # -> Branch0, Branch1, Branch2, Branch3, Branch4, Branch5, Branch6, Branch7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; disabled
geometry_15 = Geometry(explode_tree.Branch0)
geometry_16 = Geometry(explode_tree.Branch3)
geometry_17 = Geometry(explode_tree.Branch1)
geometry_18 = Geometry(explode_tree.Branch2)
geometry_19 = Geometry(explode_tree.Branch4)
geometry_20 = Geometry(explode_tree.Branch5)
geometry_21 = Geometry(explode_tree.Branch6)
geometry_22 = Geometry(explode_tree.Branch7)
geometry_23 = Geometry(explode_tree.Branch8)
geometry_24 = Geometry(explode_tree.Branch9)
geometry_25 = Geometry(explode_tree.Branch10)
geometry_26 = Geometry(explode_tree.Branch12)
geometry_27 = Geometry(explode_tree.Branch11)
geometry_28 = Geometry(explode_tree_2.Branch0)  # disabled
geometry_29 = Geometry(explode_tree_2.Branch3)  # disabled
geometry_30 = Geometry(explode_tree_2.Branch1)  # disabled
geometry_31 = Geometry(explode_tree_2.Branch2)  # disabled
geometry_32 = Geometry(explode_tree_2.Branch4)  # disabled
geometry_33 = Geometry(explode_tree_2.Branch6)  # disabled
geometry_34 = Geometry(explode_tree_2.Branch5)  # disabled
geometry_35 = Geometry(explode_tree_2.Branch7)  # disabled
geometry_36 = Geometry(explode_tree_2.Branch8)  # disabled
geometry_37 = Geometry(explode_tree_2.Branch9)  # disabled
geometry_38 = Geometry(explode_tree_2.Branch10)  # disabled
geometry_39 = Geometry(explode_tree_2.Branch12)  # disabled
geometry_40 = Geometry(explode_tree_2.Branch11)  # disabled
line_8 = Line(geometry_24)  # disabled
line_9 = Line(geometry_25)  # disabled
line_10 = Line(geometry_27)  # disabled
line_11 = Line(geometry_23)  # disabled
line_12 = Line(geometry_21)  # disabled
line_13 = Line(geometry_22)  # disabled
line_14 = Line(geometry_20)  # disabled
line_15 = Line(geometry_16)  # disabled
line_16 = Line(geometry_15)  # disabled
line_17 = Line(geometry_17)  # disabled
line_18 = Line(geometry_18)  # disabled
line_19 = Line(geometry_19)  # disabled
line_20 = Line(line_6)  # disabled
line_21 = Line(geometry_26)  # disabled
reaction_forces_karamba3d = ReactionForcesKaramba3D(AnalyzedModel=analyze_karamba3d.CalculatedModel, LoadCase=series)  # -> AnalyzedModel, ReactionForces_kN, ReactionMoments_kNm, SupportPosition, SumOfReactionForces_kN, SumOfReactionMoments_kNm; disabled
bar = Bar(
    Line=line_16,
    SectionProperty=chs,
    OrientationAngle=0,
    FeaType="{ \"_t\" : \"System.Enum\", \"TypeName\" : { \"_t\" : \"System.Type\", \"Name\" : \"BH.oM.Structure.Elements.BarFEAType\", \"_bhomVersion\" : \"5.2\" }, \"Value\" : \"Flexural\", \"_bhomVersion\" : \"5.2\" }",
    Component="{ .Bar")  # disabled
bar_2 = Bar(
    Line=line_17,
    SectionProperty=chs_2,
    OrientationAngle=0,
    FeaType="{ \"_t\" : \"System.Enum\", \"TypeName\" : { \"_t\" : \"System.Type\", \"Name\" : \"BH.oM.Structure.Elements.BarFEAType\", \"_bhomVersion\" : \"5.2\" }, \"Value\" : \"Flexural\", \"_bhomVersion\" : \"5.2\" }",
    Component="{ .Bar")  # disabled
bar_3 = Bar(
    Line=line_18,
    SectionProperty=chs_3,
    OrientationAngle=0,
    FeaType="{ \"_t\" : \"System.Enum\", \"TypeName\" : { \"_t\" : \"System.Type\", \"Name\" : \"BH.oM.Structure.Elements.BarFEAType\", \"_bhomVersion\" : \"5.2\" }, \"Value\" : \"Flexural\", \"_bhomVersion\" : \"5.2\" }",
    Component="{ .Bar")  # disabled
bar_4 = Bar(
    Line=line_15,
    SectionProperty=chs_13,
    OrientationAngle=0,
    FeaType="{ \"_t\" : \"System.Enum\", \"TypeName\" : { \"_t\" : \"System.Type\", \"Name\" : \"BH.oM.Structure.Elements.BarFEAType\", \"_bhomVersion\" : \"5.2\" }, \"Value\" : \"Flexural\", \"_bhomVersion\" : \"5.2\" }",
    Component="{ .Bar")  # disabled
bar_5 = Bar(
    Line=line_19,
    SectionProperty=chs_14,
    OrientationAngle=0,
    FeaType="{ \"_t\" : \"System.Enum\", \"TypeName\" : { \"_t\" : \"System.Type\", \"Name\" : \"BH.oM.Structure.Elements.BarFEAType\", \"_bhomVersion\" : \"5.2\" }, \"Value\" : \"Flexural\", \"_bhomVersion\" : \"5.2\" }",
    Component="{ .Bar")  # disabled
bar_6 = Bar(
    Line=line_14,
    SectionProperty=chs_12,
    OrientationAngle=0,
    FeaType="{ \"_t\" : \"System.Enum\", \"TypeName\" : { \"_t\" : \"System.Type\", \"Name\" : \"BH.oM.Structure.Elements.BarFEAType\", \"_bhomVersion\" : \"5.2\" }, \"Value\" : \"Flexural\", \"_bhomVersion\" : \"5.2\" }",
    Component="{ .Bar")  # disabled
bar_7 = Bar(
    Line=line_12,
    SectionProperty=chs_10,
    OrientationAngle=0,
    FeaType="{ \"_t\" : \"System.Enum\", \"TypeName\" : { \"_t\" : \"System.Type\", \"Name\" : \"BH.oM.Structure.Elements.BarFEAType\", \"_bhomVersion\" : \"5.2\" }, \"Value\" : \"Flexural\", \"_bhomVersion\" : \"5.2\" }",
    Component="{ .Bar")  # disabled
bar_8 = Bar(
    Line=line_13,
    SectionProperty=chs_11,
    OrientationAngle=0,
    FeaType="{ \"_t\" : \"System.Enum\", \"TypeName\" : { \"_t\" : \"System.Type\", \"Name\" : \"BH.oM.Structure.Elements.BarFEAType\", \"_bhomVersion\" : \"5.2\" }, \"Value\" : \"Flexural\", \"_bhomVersion\" : \"5.2\" }",
    Component="{ .Bar")  # disabled
bar_9 = Bar(
    Line=line_11,
    SectionProperty=chs_8,
    OrientationAngle=0,
    FeaType="{ \"_t\" : \"System.Enum\", \"TypeName\" : { \"_t\" : \"System.Type\", \"Name\" : \"BH.oM.Structure.Elements.BarFEAType\", \"_bhomVersion\" : \"5.2\" }, \"Value\" : \"Flexural\", \"_bhomVersion\" : \"5.2\" }",
    Component="{ .Bar")  # disabled
bar_10 = Bar(
    Line=line_8,
    SectionProperty=chs_4,
    OrientationAngle=0,
    FeaType="{ \"_t\" : \"System.Enum\", \"TypeName\" : { \"_t\" : \"System.Type\", \"Name\" : \"BH.oM.Structure.Elements.BarFEAType\", \"_bhomVersion\" : \"5.2\" }, \"Value\" : \"Flexural\", \"_bhomVersion\" : \"5.2\" }",
    Component="{ .Bar")  # disabled
bar_11 = Bar(
    Line=line_9,
    SectionProperty=chs_6,
    OrientationAngle=0,
    FeaType="{ \"_t\" : \"System.Enum\", \"TypeName\" : { \"_t\" : \"System.Type\", \"Name\" : \"BH.oM.Structure.Elements.BarFEAType\", \"_bhomVersion\" : \"5.2\" }, \"Value\" : \"Flexural\", \"_bhomVersion\" : \"5.2\" }",
    Component="{ .Bar")  # disabled
bar_12 = Bar(
    Line=line_10,
    SectionProperty=chs_5,
    OrientationAngle=0,
    FeaType="{ \"_t\" : \"System.Enum\", \"TypeName\" : { \"_t\" : \"System.Type\", \"Name\" : \"BH.oM.Structure.Elements.BarFEAType\", \"_bhomVersion\" : \"5.2\" }, \"Value\" : \"Flexural\", \"_bhomVersion\" : \"5.2\" }",
    Component="{ .Bar")  # disabled
bar_13 = Bar(
    Line=line_21,
    SectionProperty=chs_9,
    OrientationAngle=0,
    FeaType="{ \"_t\" : \"System.Enum\", \"TypeName\" : { \"_t\" : \"System.Type\", \"Name\" : \"BH.oM.Structure.Elements.BarFEAType\", \"_bhomVersion\" : \"5.2\" }, \"Value\" : \"Flexural\", \"_bhomVersion\" : \"5.2\" }",
    Component="{ .Bar")  # disabled
bar_14 = Bar(
    Line=line_20,
    SectionProperty=chs_7,
    OrientationAngle=0,
    FeaType="{ \"_t\" : \"System.Enum\", \"TypeName\" : { \"_t\" : \"System.Type\", \"Name\" : \"BH.oM.Structure.Elements.BarFEAType\", \"_bhomVersion\" : \"5.2\" }, \"Value\" : \"Flexural\", \"_bhomVersion\" : \"5.2\" }",
    Component="{ .Bar")  # disabled
deconstruct_vector = DeconstructVector(Vector=reaction_forces_karamba3d.ReactionForces_kN)  # -> XComponent, YComponent, ZComponent; disabled
merge_22 = Merge(
    Data1=bar,
    Data2=bar_2,
    Data3=bar_3,
    Data4=bar_4,
    Data5=bar_5,
    Data6=bar_6,
    Data7=bar_7,
    Data8=bar_8,
    Data9=bar_9,
    Data10=bar_10,
    Data11=bar_11,
    Data12=bar_12,
    Data13=bar_13)  # -> flatten(Result); disabled
line_22 = Line(line_5)  # disabled
panel_113 = Panel(deconstruct_vector.ZComponent)  # disabled
panel_114 = Panel(deconstruct_vector.YComponent)  # disabled
# Reaction Forces
panel_115 = Panel(deconstruct_vector.XComponent)  # disabled
bar_15 = Bar(
    Line=line_22,
    SectionProperty=chs_15,
    OrientationAngle=0,
    FeaType="{ \"_t\" : \"System.Enum\", \"TypeName\" : { \"_t\" : \"System.Type\", \"Name\" : \"BH.oM.Structure.Elements.BarFEAType\", \"_bhomVersion\" : \"5.2\" }, \"Value\" : \"Flexural\", \"_bhomVersion\" : \"5.2\" }",
    Component="{ .Bar")  # disabled

# ---- group: out_
ghpython_script_3 = GhPythonScript(LC_names_List=assemble_model_karamba3d.LoadCaseNames)  # -> LC_number; inputs LC_names_List: list
# ---------- ghpython_script_3: Python ----------
__author__ = "AOMAN"
__version__ = "2022.08.12"

import rhinoscriptsyntax as rs
iteration_list = LC_names_List
LC_number = []

for i in iteration_list:
    split_list = i.split("LC")
    LC_number.append(split_list[1])
# ---------- end ghpython_script_3 ----------
sort_list_24 = SortList(Keys=ghpython_script_3, ValuesValuesA=analyze_karamba3d.MaximumDisplacement_cm)  # -> Keys, ValuesValuesA
sort_list_25 = SortList(Keys=ghpython_script_3, ValuesValuesA=assemble_model_karamba3d.LoadCaseNames)  # -> Keys, ValuesValuesA
panel_116 = Panel(sort_list_24.ValuesValuesA)

# ----
panel_117 = Panel("""18
9
9""")
partition_list = PartitionList(List=sort_list_24.ValuesValuesA, Size=panel_117)  # -> simplify(Chunks)
partition_list_2 = PartitionList(List=sort_list_25.ValuesValuesA, Size=panel_117)  # -> simplify(Chunks)

# ---- group: out_ (continued)
panel_118 = Panel(partition_list_2)

# ----
panel_119 = Panel("""{0}
{3}""")
tree_branch = TreeBranch(Tree=partition_list_2, Path=panel_119, MaintainPaths=True)
tree_branch_2 = TreeBranch(Tree=partition_list, Path=panel_119, MaintainPaths=True)
panel_120 = Panel(tree_branch)
panel_121 = Panel(tree_branch_2)
sort_list_26 = SortList(Keys=flatten(tree_branch_2), ValuesValuesA=flatten(tree_branch))  # -> Keys, ValuesValuesA
# Critical Load Case Identification
# Strength
list_item_30 = ListItem(List=sort_list_26.ValuesValuesA, Index="-1", Wrap=True)
panel_122 = Panel(list_item_30)

tree_branch_3 = TreeBranch(Tree=partition_list_2, Path="{1}", MaintainPaths=True)
tree_branch_4 = TreeBranch(Tree=partition_list, Path="{1}", MaintainPaths=True)
panel_123 = Panel(tree_branch_4)
panel_124 = Panel(tree_branch_3)
sort_list_27 = SortList(Keys=flatten(tree_branch_4), ValuesValuesA=flatten(tree_branch_3))  # -> Keys, ValuesValuesA
# Deflection Limit
list_item_31 = ListItem(List=sort_list_27.ValuesValuesA, Index="-1", Wrap=True)
panel_125 = Panel(list_item_31)

tree_branch_5 = TreeBranch(Tree=partition_list, Path="{2}", MaintainPaths=True)
tree_branch_6 = TreeBranch(Tree=partition_list_2, Path="{2}", MaintainPaths=True)
panel_126 = Panel(tree_branch_5)
panel_127 = Panel(tree_branch_6)
# Maximum Deflection
sort_list_28 = SortList(Keys=flatten(tree_branch_5), ValuesValuesA=flatten(tree_branch_6))  # -> Keys, ValuesValuesA
list_item_32 = ListItem(List=sort_list_28.ValuesValuesA, Index="-1", Wrap=True)
panel_128 = Panel(list_item_32)

# ---- group: analysis_
# Dead and live
# 	Dead and wind
disassemble_model_karamba3d_7 = DisassembleModelKaramba3D(Model=assemble_model_karamba3d.Model)  # -> Model, Point, Beam, Shell, Support, Load, Line, Mesh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
nodal_displacements_karamba3d = NodalDisplacementsKaramba3D(AnalyzedModel=analyze_karamba3d.CalculatedModel, PositionsIndexes=disassemble_model_karamba3d_7.Point, LoadCase=panel_33)  # -> AnalyzedModel, NodalTranslations_m, NodalRotations_rad
list_length_6 = ListLength(List=nodal_displacements_karamba3d.NodalTranslations_m)
deconstruct = Deconstruct(Point=nodal_displacements_karamba3d.NodalTranslations_m)  # -> XComponent, YComponent, ZComponent
deflections = Data(deconstruct.ZComponent)
absolute_4 = Absolute(Value=deflections)
division_8 = Division(A=simplify(graft(list_item_9)), B=simplify(graft(absolute_4)))  # -> flatten(Result)
list_length_7 = ListLength(List=division_8)
null_item = NullItem(Item=division_8)  # -> NullFlags, InvalidFlags, Description
series_9 = Series(Start=0, Step=1, Count=list_length_7)
cull_pattern_13 = CullPattern(List=series_9, CullPattern=null_item.NullFlags)
curve = Curve(deflection_boundaries)
point_in_curves_2 = PointInCurves(Point=flatten_tree, Curves=curve)  # -> Relationship, Index, Point
cull_pattern_14 = CullPattern(List=flatten_tree, CullPattern=point_in_curves_2.Relationship)

nodal_displacements_karamba3d_2 = NodalDisplacementsKaramba3D(AnalyzedModel=analyze_karamba3d.CalculatedModel, PositionsIndexes=disassemble_model_karamba3d_7.Point, LoadCase=panel_33)  # -> AnalyzedModel, NodalTranslations_m, NodalRotations_rad
deconstruct_2 = Deconstruct(Point=nodal_displacements_karamba3d_2.NodalTranslations_m)  # -> XComponent, YComponent, ZComponent
deflections_2 = Data(deconstruct_2.ZComponent)
absolute_5 = Absolute(Value=deflections_2)
number_slider_10 = Slider(180, range=0..1000)
division_9 = Division(A=simplify(graft(list_item_9)), B=simplify(graft(absolute_5)))  # -> flatten(Result)
addition_2 = Addition(A=number_slider_10, B=Slider(1, range=0..1))
list_length_8 = ListLength(List=division_9)
null_item_2 = NullItem(Item=division_9)  # -> NullFlags, InvalidFlags, Description
series_10 = Series(Start=0, Step=1, Count=list_length_8)
cull_pattern_15 = CullPattern(List=series_10, CullPattern=null_item_2.NullFlags)
replace_items = ReplaceItems(List=division_9, Item=addition_2, Indices=cull_pattern_15, Wrap=False)
round = Round(Number=replace_items)  # -> Nearest, Floor, Ceiling
cull_pattern_16 = CullPattern(List=round.Floor, CullPattern=invert(point_in_curves_2.Relationship))
cull_pattern_17 = CullPattern(List=flatten_tree, CullPattern=invert(point_in_curves_2.Relationship))
larger_than_5 = LargerThan(FirstNumber=cull_pattern_16, SecondNumber=number_slider_10)  # -> LargerThan, OrEqualTo
cull_pattern_18 = CullPattern(List=cull_pattern_16, CullPattern=invert(larger_than_5.OrEqualTo))
cull_pattern_19 = CullPattern(List=cull_pattern_17, CullPattern=invert(larger_than_5.OrEqualTo))
subtraction_2 = Subtraction(A=cull_pattern_16, B=number_slider_10)
text_tag_3d_2 = TextTag3D(Location=cull_pattern_17, Text=subtraction_2, Size="0.2", Justification=7)
bnd = Bounds(Numbers=cull_pattern_18)
dedomain = DeconstructDomain(Domain=bnd)  # -> Start, End
panel_129 = Panel("""Live 
Wind""")
gradient_3 = Gradient(
    LowerLimit=dedomain.End,
    UpperLimit=dedomain.Start,
    Parameter=cull_pattern_18,
    stops=[0: RGB(0, 128, 0), 0.483: RGB(255, 255, 0), 1: RGB(255, 0, 0)])
text_tag_3d_3 = TextTag3D(Location=cull_pattern_19, Text=cull_pattern_18, Size="0.2", Justification=7)
list_length_9 = ListLength(List=cull_pattern_19)
preview = CustomPreview(Geometry=cull_pattern_19, Material=gradient_3)

# ----
nodal_displacements_karamba3d_3 = NodalDisplacementsKaramba3D(AnalyzedModel=analyze_karamba3d.CalculatedModel, PositionsIndexes=disassemble_model_karamba3d_7.Point, LoadCase="LC28")  # -> AnalyzedModel, NodalTranslations_m, NodalRotations_rad
deconstruct_3 = Deconstruct(Point=nodal_displacements_karamba3d_3.NodalTranslations_m)  # -> XComponent, YComponent, ZComponent
deflections_3 = Data(deconstruct_3.ZComponent)
multiplication_38 = Multiplication(A=deflections, B=1000)
absolute_6 = Absolute(Value=deflections_3)
text_tag_3d_4 = TextTag3D(Location=disassemble_model_karamba3d_7.Point, Text=multiplication_38, Size="0.2", Justification=7)
sort_list_29 = SortList(Keys=absolute_6, ValuesValuesA=disassemble_model_karamba3d_7.Point)  # -> reverse(Keys), reverse(ValuesValuesA)
list_item_33 = ListItem(List=sort_list_29.ValuesValuesA, Index=negative_2, Wrap=True)
panel_130 = Panel(sort_list_29.Keys)

# ---- group: analysis_ (continued)
replace_items_2 = ReplaceItems(List=division_8, Item=addition_2, Indices=cull_pattern_13, Wrap=False)
round_2 = Round(Number=replace_items_2)  # -> Nearest, Floor, Ceiling
cull_pattern_20 = CullPattern(List=round_2.Floor, CullPattern=point_in_curves_2.Relationship)
larger_than_6 = LargerThan(FirstNumber=cull_pattern_20, SecondNumber=Slider(180, range=0..1000))  # -> LargerThan, OrEqualTo
# If the max deflection is still greater than the limit, then you'll need to use: (current section area) x [1 + { magnifier x (max deflection / limit) - 1 } x (current stress / max stress) ] = new section area required
cull_pattern_21 = CullPattern(List=cull_pattern_20, CullPattern=invert(larger_than_6.LargerThan))
cull_pattern_22 = CullPattern(List=cull_pattern_14, CullPattern=invert(larger_than_6.LargerThan))
bnd_2 = Bounds(Numbers=cull_pattern_21)
list_length_10 = ListLength(List=cull_pattern_22)
dedomain_2 = DeconstructDomain(Domain=bnd_2)  # -> Start, End
gradient_4 = Gradient(
    LowerLimit=dedomain_2.End,
    UpperLimit=dedomain_2.Start,
    Parameter=cull_pattern_21,
    stops=[0: RGB(0, 128, 0), 0.483: RGB(255, 255, 0), 1: RGB(255, 0, 0)])
# Deflection Check
text_tag_3d_5 = TextTag3D(Location=cull_pattern_22, Text=cull_pattern_21, Size="0.2", Justification=7)
preview_2 = CustomPreview(Geometry=cull_pattern_22, Material=gradient_4)

# Maximum Deflection 75mm
nodal_displacements_karamba3d_4 = NodalDisplacementsKaramba3D(AnalyzedModel=analyze_karamba3d.CalculatedModel, PositionsIndexes=disassemble_model_karamba3d_7.Point, LoadCase=panel_32)  # -> AnalyzedModel, NodalTranslations_m, NodalRotations_rad
deconstruct_4 = Deconstruct(Point=nodal_displacements_karamba3d_4.NodalTranslations_m)  # -> XComponent, YComponent, ZComponent
deflections_4 = Data(deconstruct_4.ZComponent)
absolute_7 = Absolute(Value=deflections_4)
multiplication_39 = Multiplication(A=absolute_7, B="1000")
sort_list_30 = SortList(Keys=multiplication_39, ValuesValuesA=multiplication_39)  # -> Keys, ValuesValuesA
geometry_41 = Geometry(flatten_tree)
larger_than_7 = LargerThan(FirstNumber=absolute_7, SecondNumber="0.050")  # -> LargerThan, OrEqualTo
list_item_34 = ListItem(List=sort_list_30.ValuesValuesA, Index="-1", Wrap=True)
panel_131 = Panel(sort_list_30.ValuesValuesA)
cull_pattern_23 = CullPattern(List=geometry_41, CullPattern=larger_than_7.LargerThan)
cull_pattern_24 = CullPattern(List=absolute_7, CullPattern=larger_than_7.LargerThan)
panel_132 = Panel(cull_pattern_24)
multiplication_40 = Multiplication(A=cull_pattern_24, B="1000")
preview_3 = CustomPreview(Geometry=cull_pattern_23, Material=ColourSwatch(SwatchColor=RGB(237, 12, 12)))
round_3 = Round(Number=multiplication_40)  # -> Nearest, Floor, Ceiling
list_length_11 = ListLength(List=cull_pattern_24)
text_tag_3d_6 = TextTag3D(Location=cull_pattern_23, Text=round_3.Nearest, Size="0.2", Justification=7)

# ----
round_4 = Round(Number=list_item_34)  # -> Nearest, Floor, Ceiling

# ---- group: analysis_ (continued)
concatenate_5 = Concatenate(Fragment_A="Maximum wind load deflection is ", Fragment_B=round_4.Nearest, A=" mm")

# ----
multiplication_41 = Multiplication(A=deflections_4, B=1000)
text_tag_3d_7 = TextTag3D(Location=disassemble_model_karamba3d_7.Point, Text=multiplication_41, Size="0.2", Justification=7)

# ---- group: analysis_
number_of_points_in_the_cantilevering_pa = Data(list_length_10)  # "Number of points in the cantilevering part which are exceeding the span/deflection ratio"
number_of_points_in_the_non_cantileverin = Data(list_length_11)  # "Number of points in the non-cantilevering part which are exceeding the span/deflection ratio"
number_of_points_in_the_non_cantileverin_2 = Data(list_length_9)  # "Number of points in the non cantilevering part which are exceeding the 50mm deflection limit"
addition_3 = Addition(
    A=number_of_points_in_the_cantilevering_pa,
    B=number_of_points_in_the_non_cantileverin_2,
    C=number_of_points_in_the_non_cantileverin)

# ----
panel_133 = Panel(addition_3)
equality_3 = Equality(FirstNumber=addition_3, SecondNumber="0")  # -> Equality, Inequality
concatenate_6 = Concatenate(Fragment_A="Maximum wind load deflection is ", Fragment_B=round_4.Nearest, A=" mm")
stream_filter_2 = StreamFilter(Gate=equality_3.Equality, Stream0="The Roof Fails for Deflection !!!", Stream1="The Roof Passes for Deflection")

# ----
# Result Check
strength_check = Panel(stream_filter)
deflection_check = Panel(stream_filter_2)
deflection_check_wind = Panel(concatenate_5)

number_slider_11 = Slider(0.175, range=0..1)  # disabled

disassemble_model_karamba3d_8 = DisassembleModelKaramba3D(Model=model)  # -> Model, Point, Beam, Shell, Support, Load, Line, Mesh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; disabled
evaluate_length = EvaluateLength(Curve=disassemble_model_karamba3d_8.Line, Length=number_slider_11, Normalized=False)  # -> Point, Tangent, Parameter; disabled

length = Length(Curve=disassemble_model_karamba3d_8.Line)  # disabled
subtraction_3 = Subtraction(A=length, B=number_slider_11)  # disabled

evaluate_length_2 = EvaluateLength(Curve=disassemble_model_karamba3d_8.Line, Length=subtraction_3, Normalized=False)  # -> Point, Tangent, Parameter; disabled
line_23 = Line(StartPoint=evaluate_length.Point, EndPoint=evaluate_length_2.Point)  # disabled

number_slider_12 = Slider(0, range=0..0.1)  # disabled
evaluate_length_3 = EvaluateLength(Curve=disassemble_model_karamba3d_8.Line, Length=number_slider_11, Normalized=False)  # -> Point, Tangent, Parameter; disabled
evaluate_length_4 = EvaluateLength(Curve=disassemble_model_karamba3d_8.Line, Length=number_slider_12, Normalized=False)  # -> Point, Tangent, Parameter; disabled
line_24 = Line(StartPoint=evaluate_length_4.Point, EndPoint=evaluate_length_3.Point)  # disabled

number_slider_13 = Slider(1, range=0..1)  # disabled
evaluate_length_5 = EvaluateLength(Curve=disassemble_model_karamba3d_8.Line, Length=number_slider_13, Normalized=True)  # -> Point, Tangent, Parameter; disabled
evaluate_length_6 = EvaluateLength(Curve=disassemble_model_karamba3d_8.Line, Length=subtraction_3, Normalized=False)  # -> Point, Tangent, Parameter; disabled
line_25 = Line(StartPoint=evaluate_length_5.Point, EndPoint=evaluate_length_6.Point)  # disabled

cull_pattern_25 = CullPattern(List=line_23, CullPattern=invert(larger_than_4.LargerThan))  # disabled
cull_pattern_26 = CullPattern(List=division_7, CullPattern=invert(larger_than_4.LargerThan))  # disabled
boolean_toggle_3 = BooleanToggle(True)  # disabled
pipe = Pipe(Curve=simplify(graft(cull_pattern_25)), Radius=simplify(graft(cull_pattern_26)), Caps=boolean_toggle_3)  # disabled

# ----
# (current section area) x [1 + { magnifier x (max deflection / limit) - 1 } x (current stress / max stress) ]
number_slider_14 = Slider(25, range=0..100)  # disabled
merge_23 = Merge(Data1=line_24, Data2=line_25)  # disabled
remove_duplicate_lines_karamba3d_4 = RemoveDuplicateLinesKaramba3D(Line=merge_23, LimitDistance=0.005)  # -> OutLine, Info, Indexes; disabled
division_10 = Division(A=number_slider_14, B=1000)  # disabled
pipe_2 = Pipe(Curve=remove_duplicate_lines_karamba3d_4.OutLine, Radius=division_10, Caps=0)  # disabled

cull_pattern_27 = CullPattern(List=division_7, CullPattern=larger_than_4.LargerThan)  # disabled
data_5 = Data(cull_pattern_27)  # disabled
boolean_toggle_4 = BooleanToggle(True)  # disabled

cull_pattern_28 = CullPattern(List=line_23, CullPattern=larger_than_4.LargerThan)  # disabled
number_slider_15 = Slider(0, range=0..100)  # disabled
number_slider_16 = Slider(1, range=0..100)  # disabled
geometry_42 = Geometry(cull_pattern_28)  # disabled
evaluate_length_7 = EvaluateLength(Curve=geometry_42, Length=number_slider_15, Normalized=True)  # -> Point, Tangent, Parameter; disabled
evaluate_length_8 = EvaluateLength(Curve=geometry_42, Length=number_slider_16, Normalized=True)  # -> Point, Tangent, Parameter; disabled
number_slider_17 = Slider(0.05, range=0..0.1)  # disabled
perp_frame = PerpFrame(Curve=geometry_42, Parameter=evaluate_length_7.Parameter)  # disabled
perp_frame_2 = PerpFrame(Curve=geometry_42, Parameter=evaluate_length_8.Parameter)  # disabled
circle = Circle(Plane=perp_frame, Radius=number_slider_17)  # -> simplify(graft(Circle)); disabled
circle_2 = Circle(Plane=perp_frame_2, Radius=number_slider_17)  # -> simplify(graft(Circle)); disabled
point_on_curve = PointOnCurve(circle, parameter=0.5)  # disabled

geometry_43 = Geometry(cull_pattern_28)  # disabled
length_2 = Length(Curve=geometry_43)  # disabled
subtraction_4 = Subtraction(A=length_2, B=data_5)  # disabled
evaluate_length_9 = EvaluateLength(Curve=geometry_43, Length=data_5, Normalized=False)  # -> Point, Tangent, Parameter; disabled
evaluate_length_10 = EvaluateLength(Curve=geometry_43, Length=subtraction_4, Normalized=False)  # -> Point, Tangent, Parameter; disabled
perp_frame_3 = PerpFrame(Curve=geometry_43, Parameter=evaluate_length_9.Parameter)  # disabled
perp_frame_4 = PerpFrame(Curve=geometry_43, Parameter=evaluate_length_10.Parameter)  # disabled
line_26 = Line(StartPoint=evaluate_length_9.Point, EndPoint=evaluate_length_10.Point)  # disabled
circle_3 = Circle(Plane=perp_frame_3, Radius=data_5)  # -> simplify(graft(Circle)); disabled
circle_4 = Circle(Plane=perp_frame_4, Radius=data_5)  # -> simplify(graft(Circle)); disabled
pipe_3 = Pipe(Curve=simplify(graft(line_26)), Radius=simplify(graft(data_5)), Caps=boolean_toggle_4)  # disabled

point_on_curve_2 = PointOnCurve(circle_3, parameter=0.5)  # disabled
line_27 = Line(StartPoint=point_on_curve, EndPoint=point_on_curve_2)  # disabled
# Clash_Detection
sweep2 = Sweep2(Rail1=circle, Rail2=circle_3, Sections=line_27, SameHeight=False)  # disabled

point_on_curve_3 = PointOnCurve(circle_2, parameter=0.5)  # disabled
point_on_curve_4 = PointOnCurve(circle_4, parameter=0.5)  # disabled
line_28 = Line(StartPoint=point_on_curve_3, EndPoint=point_on_curve_4)  # disabled
sweep2_2 = Sweep2(Rail1=circle_2, Rail2=circle_4, Sections=line_28, SameHeight=False)  # disabled
cap_holes = CapHoles(Brep=sweep2_2)  # disabled

cap_holes_2 = CapHoles(Brep=sweep2)  # disabled
colour_swatch = ColourSwatch(SwatchColor=RGB(224, 195, 118))  # disabled
colour_swatch_2 = ColourSwatch(SwatchColor=RGB(80, 127, 255))  # disabled
colour_swatch_3 = ColourSwatch(SwatchColor=RGB(230, 25, 84))  # disabled
geometry_44 = Geometry(sphere)  # disabled
geometry_45 = Geometry(pipe_2)  # disabled
geometry_46 = Geometry([pipe_3, cap_holes_2, cap_holes, pipe])  # disabled
custom_preview = CustomPreview(Geometry=geometry_44, Material=colour_swatch)  # disabled
custom_preview_2 = CustomPreview(Geometry=geometry_46, Material=colour_swatch_2)  # disabled
custom_preview_3 = CustomPreview(Geometry=geometry_45, Material=colour_swatch_3)  # disabled

merge_24 = Merge(Data1=geometry_44, Data2=geometry_46, Data3=geometry_45)  # disabled
